# Grasshopper definition Hive_Full_Workflow.gh (Grasshopper 1.0.7)
# plug-ins: HiveIO, solar, sia380, GHSolar, epw-reader

# ---- group: Pfad zur Wetterdatei (*.epw)
panel = Panel("C:\Users\chwaibel\Documents\GitHub\hive\GrasshopperExamples\LectureExercises\HIVE_Zurich.epw")

# ----
panel_2 = Panel("C:\EnergyPlusV9-1-0\WeatherData\USA_FL_Tampa.Intl.AP.722110_TMY3.epw")

# ---- group: PV Fläche
srf = Surface(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)

# ---- group: Gebäudevolumen
brep = Brep(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)

# ---- group: Fensterflächen
srf_2 = Surface([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])

# ---- group: Boden
mesh = Mesh(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)

# ---- group: Umgebungsbebauung
mesh_2 = Mesh([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])

# ----
mesh_uv = MeshSurface(Surface=srf, UCount="6", VCount="6", Overhang=True, Equalize=False)
hiveinputenergysystems = InputEnergySystemsHive(SolarTechProperties=mesh_uv)  # -> flatten(EnergySystems)
hive_io_env = HiveIOEnvironment(EPWPath=panel_2, ObstaclesGeometry=[mesh, mesh_2])
hive_io_bldg = HiveIOBuilding(ZoneBrepGeometries=brep, WindowsSurfaces=srf_2)
hiveiodistr = HiveIODistributor(HiveInputObjects=[hive_io_env, hive_io_bldg, hiveinputenergysystems])  # -> HiveIOBuilding, HiveIOEnvironment, HiveIOEnergySystemSurfaceBasedTech, HiveIOEnergySystemConversionTech, HiveIOEnergySystemsEmitter

# ---- group: shading mask rec level
number_slider = Slider(5, range=0..5)
number_slider_2 = Slider(0.089, range=0..2)
toggle = BooleanToggle(False)

# ---- group: sun vector HOY
number_slider_3 = Slider(2294, range=0..8759)
toggle_2 = BooleanToggle(False)

# ---- group: show sunpath
toggle_3 = BooleanToggle(False)

# ---- group: Simple efficiency calculations?
toggle_4 = BooleanToggle(False)

# ---- group: Simulate solar?
toggle_5 = BooleanToggle(False)

# ----
nickname = GhDistributorConversionTech(HiveIOEnergySystemConversionTech=hiveiodistr.HiveIOEnergySystemConversionTech)  # -> HiveIOEnergySystemAirSourceHeatPump, HiveIOEnergySystemChiller, HiveIOEnergySystemsBoiler, HiveIOEnergySystemsCombinedHeatPowert, HiveIOEnergySystemsHeatExchanger, HiveIOEnergySystemsCoolExchanger, HiveIOEnergySystemElectricalSubstation
distrsolar = HiveIODistributorSolar(
    HiveIOBuilding=hiveiodistr.HiveIOBuilding,
    HiveIOEnergySystemSurfaceBased=hiveiodistr.HiveIOEnergySystemSurfaceBasedTech,
    HiveIOEnvironment=hiveiodistr.HiveIOEnvironment)  # -> EnvironmentMesh, BuildingCentroid, ExternalSurfaces, WindowGeometries, SolarTechMesh, WindowAzimuth, WindowAreas, SolarTechMesh_2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
hiveiodistrsupsys = HiveIODistributorSupplySystem(HiveIOEnergySystemsSurfaceBased=hiveiodistr.HiveIOEnergySystemSurfaceBasedTech)  # -> EfficiencyPV, PVAreas, EfficiencyST, STAreas, ElectricEfficiencyPVT, ThermalEfficiencyPVT, PVTAreas
distributorsia = DistributorSIA(BuildingObj=hiveiodistr.HiveIOBuilding)  # -> ZoneAreas, WindowsAreas, ExtSrfAreas, SIA2024json
hivedistenvironment = DistributorEnvironmentHive(HiveIOEnvironment=hiveiodistr.HiveIOEnvironment)  # -> Filepath, NaturalGas, BioGas, WoodPellets, DistrictHeating, DistrictCooling, GridElectricity, AmbientAirTemp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
epw_reader = EPWReader(Path=hivedistenvironment.Filepath)  # -> Latitude, Longitude, CityCountry, GHI, DNI, DHI, DryBulb, DewPoint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
sia2024 = SIA2024Rooms(
    Room=distributorsia.SIA2024json,
    Area=distributorsia.ZoneAreas,
    Month=[1, 2, 3, 4, 5, 6, 7, 8, 9, 10, 11, 12],
    Season="winter")  # -> Τ_h, Θ_i_C, T_h, A_op_m2, A_w_m2, U_op_W_m2K, U_w_W_m2K, V_e_m3_h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
python = GhPythonScript(x=distrsolar.WindowGeometries, y=toggle_5)  # -> out, a
# ---------- python: Python ----------
__author__ = "chwaibel"
__version__ = "2020.09.09"

import rhinoscriptsyntax as rs

if y:
    a = x
# ---------- end python ----------
python_2 = GhPythonScript(x=distrsolar.SolarTechMesh_2, y=toggle_5)  # -> out, a; same code as python
adaptcomf = AdaptiveComfort(T_m=epw_reader.DryBulbMonthly)  # -> T_n, T_n80ub, T_n80lb, T_n90ub, T_n90lb

# ---- group: DHI
data = Data(epw_reader.DHI)

# ----
# Shading Mask
dni = Data(epw_reader.DNI)
panel_3 = Panel([epw_reader.Longitude, epw_reader.Latitude])
pt = Point(distrsolar.BuildingCentroid)
skydome = GHSkydome(
    RecursionLevel=number_slider,
    Viewfactors=toggle,
    CumSkyMatrix=Toggle(False),
    SunPath=toggle_3,
    SolarVec=toggle_2,
    HOY=number_slider_3,
    Location=panel_3,
    DNI=dni,
    DHI=data,
    Size=number_slider_2,
    Context=distrsolar.EnvironmentMesh,
    Sp=pt)  # -> Mesh, Vectors, Sunpaths, SunGeo

# ----
# Solare Wärmeeinträge (unshaded)
simplepanel = SimplePanel(
    Tilt=distrsolar.SolarTechMesh,
    Azimuth=distrsolar.WindowAzimuth,
    DHI=epw_reader.DHI,
    DNI=epw_reader.DNI,
    Latitude=epw_reader.Latitude,
    Longitude=epw_reader.Longitude,
    Aw=distrsolar.WindowAreas)
python_3 = GhPythonScript(x=simplify(simplepanel), month=[0, 1, 2, 3, 4, 5, 6, 7, 8, 9, 10, 11])  # -> out, a; inputs x: list, month: Int32
# ---------- python_3: Python ----------
__author__ = "chwaibel"
__version__ = "2020.02.25"

import rhinoscriptsyntax as rs

# 8760 time series
# get monthly average...
# how to know how many days a month? somewhere, I have typical year.
# in some honey-badger script

dayspermonth = [31.0, 28.0, 31.0, 30.0, 31.0, 30.0, 31.0, 31.0, 30.0, 31.0, 30.0, 31.0]

hour_per_day = 24
start_hour = int(hour_per_day * sum(dayspermonth[0:month])) 
end_hour = int(hour_per_day * sum(dayspermonth[0:month+1]))

cumulative_data = sum(x[start_hour:end_hour])

a = cumulative_data / 1000
# ---------- end python_3 ----------

# ----
# PV Ertrag (unverschattet)
# Q_s = G * F_F * A_w * g
# [Q_s] = kWh
# [G] = kWh/m^2
# [F_F] = -
# [A_w] = m^2
# [g] = -
simplepanel_2 = SimplePanel(
    Tilt=distrsolar.SolarTechTilt,
    Azimuth=distrsolar.SolarTechAzimuth,
    DHI=epw_reader.DHI,
    DNI=epw_reader.DNI,
    Latitude=epw_reader.Latitude,
    Longitude=epw_reader.Longitude)

# ---- group: NEW SIA 380 COMPONENT
# DEMAND MODELING
subtraction = Subtraction(A=distributorsia.ExtSrfAreas, B=distributorsia.WindowsAreas)
python_4 = GhPythonScript(transparent=distrsolar.WindowAreas, opaque=subtraction)  # -> out, flatten(a); inputs transparent: list, opaque: list
# ---------- python_4: Python ----------
__author__ = "Christoph"
__version__ = "2020.09.12"

import rhinoscriptsyntax as rs

a = []
for trans in transparent:
    a.append("transp")
    
for op in opaque:
    a.append("opaque")
# ---------- end python_4 ----------
merge = Merge(Data1=distrsolar.WindowAreas, Data2=subtraction)  # -> flatten(Result)
panel_4 = Panel(python_4.a)

# ----
# SOLAR SIMULATION
data_2 = Data([0.8, 0.8, 0.8, 0.8, 0.8, 0.8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])
mesh_3 = Mesh(distrsolar.ExternalSurfaces)
obstobj = ObstacleObject(
    Mesh=[distrsolar.EnvironmentMesh, mesh_3],
    Albedo=data_2,
    SpecCoeff=data_2,
    ReflType=0,
    Tolerance=0.01,
    Name="PV",
    MT=True)
item = ListItem(List=sia2024.G_, Index=0, Wrap=True)

# ---- group: NEW SIA 380 COMPONENT / unobstructed
c_script = CSharpScript(G=python_3.a, g=item)  # -> out, Q_s; inputs G: tree of Double, g: Double
# ---------- c_script: C# ----------
    int winCount = G.BranchCount;
    double [][] Q_array = new double[12][];
    for(int j = 0; j < G.Branch(0).Count; j++)
      Q_array[j] = new double[G.BranchCount];

    DataTree<double> doubleTree = new DataTree<double>();
    for (int i = 0; i < G.BranchCount; i++)
    {
      for (int j = 0; j < G.Branch(i).Count; ++j) // should be 12, 1 for each month of the year
      {
        GH_Path path = new GH_Path(i, j);
        double irrad = G.Branch(i)[j] * g;
        doubleTree.Add(irrad, path);

        Q_array[j][i] = irrad*1000;
      }
    }
    jagged jag = new jagged();
    jag.data = Q_array;

    Q_s = jag;
# ---------- c_script: C# additional code ----------
  public struct jagged
  {
    public double [][] data;
  }
# ---------- end c_script ----------

# ----
# Solare Wärmeeinträge (shaded)
mesh_4 = MeshBrep(
    Brep=python.a,
    Settings={GridMaxCount=0, GridMinCount=16, JaggedSeams=False, MaxEdgeLength=0, MinEdgeLength=0.0001, MinTolerance=0, Refine=True, RefineAngle=0, RelativeTolerance=0.65, SimplePlanes=True, Tolerance=0})
obstobj_2 = ObstacleObject(Mesh=mesh_4, Albedo=data_2, SpecCoeff=data_2, ReflType=0, Tolerance=0.01, Name="PV", MT=True)
irrmshy = IrradiationMeshYear(
    AnalysisObjects=obstobj_2,
    ObstacleObjects=obstobj,
    Latitude=epw_reader.Latitude,
    Longitude=epw_reader.Longitude,
    Year=2017,
    DNI=epw_reader.DNI,
    DHI=epw_reader.DHI,
    MainSkyRes=1,
    SpecBounces=0,
    DiffIReflSkyRes=0,
    DiffIReflMode=2,
    MT=True)
readresults = ReadResults(Mesh=mesh_4, I=irrmshy, Value=7)  # -> simplify(Results), SP
python_5 = GhPythonScript(x=simplify(readresults.Results), month=[0, 1, 2, 3, 4, 5, 6, 7, 8, 9, 10, 11])  # -> out, a; inputs x: list, month: Int32
# ---------- python_5: Python ----------
__author__ = "chwaibel"
__version__ = "2020.02.25"

import rhinoscriptsyntax as rs

# 8760 time series
# get monthly average...
# how to know how many days a month? somewhere, I have typical year.
# in some honey-badger script
if not x:
    a = None
else:
    a = runit()

print(not x)

def runit():
    dayspermonth = [31.0, 28.0, 31.0, 30.0, 31.0, 30.0, 31.0, 31.0, 30.0, 31.0, 30.0, 31.0]
    
    hour_per_day = 24
    start_hour = int(hour_per_day * sum(dayspermonth[0:month])) 
    end_hour = int(hour_per_day * sum(dayspermonth[0:month+1]))
    
    cumulative_data = sum(x[start_hour:end_hour])
    
    a = cumulative_data / 1000
    return a
# ---------- end python_5 ----------
visumshsol = VisualizeMeshSolar(Mesh=mesh_4, I=irrmshy, Value=0)

# ---- group: NEW SIA 380 COMPONENT / obstructed
c_script_2 = CSharpScript(G=python_5.a, g=item)  # -> out, Q_s; inputs G: tree of Double, g: Double; same code as c_script
python_6 = GhPythonScript(x=c_script_2.Q_s, y=toggle_5)  # -> out, a
# ---------- python_6: Python ----------
__author__ = "chwaibel"
__version__ = "2020.09.09"

import rhinoscriptsyntax as rs

if y:
    a = x
else:
    a = None
# ---------- end python_6 ----------

# ---- group: NEW SIA 380 COMPONENT (continued)
sia380 = SIA380(
    Room_properties=distributorsia.SIA2024json,
    Floor_area=distributorsia.ZoneAreas,
    T_e=epw_reader.DryBulbMonthly,
    Setpoints_ub=adaptcomf.T_n90ub,
    Setpoints_lb=adaptcomf.T_n90lb,
    Surface_areas=merge,
    Surface_type=panel_4,
    Q_s_per_surface=python_6.a,
    Q_s_per_surfaceUnobstructed=c_script.Q_s)  # -> Q_Heat, Q_Cool, Q_Elec, Q_T, Q_V, Q_i, Q_s, Q_T_opaque, Q_T_transparent
ma = MassAddition(Input=sia380.Q_Heat)  # -> Result, PartialResults
abs = Absolute(Value=sia380.Q_Cool)
division = Division(A=ma.Result, B=distributorsia.ZoneAreas)

# ----
panel_5 = Panel(python_5.a)

# ----
# PV Ertrag (simuliert)
obstobj_3 = ObstacleObject(Mesh=python_2.a, Albedo=data_2, SpecCoeff=data_2, ReflType=0, Tolerance=0.01, Name="PV", MT=True)
irrmshy_2 = IrradiationMeshYear(
    AnalysisObjects=obstobj_3,
    ObstacleObjects=obstobj,
    Latitude=epw_reader.Latitude,
    Longitude=epw_reader.Longitude,
    Year=2017,
    DNI=epw_reader.DNI,
    DHI=epw_reader.DHI,
    MainSkyRes=1,
    SpecBounces=0,
    DiffIReflSkyRes=0,
    DiffIReflMode=2,
    MT=True)
readresults_2 = ReadResults(Mesh=distrsolar.SolarTechMesh_2, I=irrmshy_2, Value=7)  # -> Results, SP
python_7 = GhPythonScript(x=simplify(readresults_2.Results), month=[0, 1, 2, 3, 4, 5, 6, 7, 8, 9, 10, 11])  # -> out, a; inputs x: list, month: Int32; same code as python_3
visumshsol_2 = VisualizeMeshSolar(Mesh=distrsolar.SolarTechMesh_2, I=irrmshy_2, Value=0)
c_script_3 = CSharpScript(G=python_7.a, g=hiveiodistrsupsys.EfficiencyPV)  # -> out, Q_s; inputs G: tree of Double, g: list of Double
# ---------- c_script_3: C# ----------
    int winCount = G.BranchCount;
    double [] Q_array = new double[12];

    DataTree<double> doubleTree = new DataTree<double>();
    for (int i = 0; i < G.BranchCount; i++)
    {
      for (int j = 0; j < G.Branch(i).Count; ++j) // should be 12, 1 for each month of the year
      {
        GH_Path path = new GH_Path(i, j);
        double irrad = G.Branch(i)[j]  * g[i];
        doubleTree.Add(irrad, path);

        Q_array[j] += irrad;
      }
    }

    Q_s = Q_array;
# ---------- end c_script_3 ----------
ma_2 = MassAddition(Input=c_script_3.Q_s)  # -> Result, PartialResults
ma_3 = MassAddition(Input=hiveiodistrsupsys.PVAreas)  # -> Result, PartialResults
division_2 = Division(A=ma_2.Result, B=ma_3.Result)

# ----
# Energy Hub
python_8 = GhPythonScript(emitters=hiveiodistr.HiveIOEnergySystemsEmitter)  # -> out, monthlyHeatingSupTemp, monthlyCoolingSupTemp, heatingCarrier, monthlyHeatingReturnTemp, yearlyHeatingSupTemp, yearlyHeatingReturnTemp, monthlyCoolingReturnTemp; inputs emitters: list
# ---------- python_8: Python ----------
__author__ = "chwaibel"
__version__ = "2020.08.20"

import rhinoscriptsyntax as rs

for e in emitters:
    if e.IsCooling:
        monthlyCoolingSupTemp = e.InletCarrier.MonthlyTemperature
        monthlyCoolingReturnTemp = e.ReturnCarrier.MonthlyTemperature
    else:
        monthlyHeatingSupTemp = e.InletCarrier.MonthlyTemperature
        heatingCarrier = e
        monthlyHeatingReturnTemp = e.ReturnCarrier.MonthlyTemperature
        yearlyHeatingSupTemp = e.InletCarrier.Temperature
        yearlyHeatingReturnTemp = e.ReturnCarrier.Temperature
# ---------- end python_8 ----------

# ----
# PV / ST
python_9 = GhPythonScript(x=irrmshy_2)  # -> out, a
# ---------- python_9: Python ----------
__author__ = "chwaibel"
__version__ = "2020.08.21"

import rhinoscriptsyntax as rs

a = x.I_hourly
# ---------- end python_9 ----------
hivemergersolartech = MergerSolarTechHive(
    I_hourlyM=python_9.a,
    SolarTech=hiveiodistr.HiveIOEnergySystemSurfaceBasedTech,
    Air=hivedistenvironment.AmbientAirTemp,
    SupplyTemp=python_8.yearlyHeatingSupTemp,
    ReturnTemp=python_8.yearlyHeatingReturnTemp,
    SimpleMode=toggle_4,
    I_hourly=simplepanel_2)
python_10 = GhPythonScript(x=hivemergersolartech)  # -> out, a
# ---------- python_10: Python ----------
__author__ = "chwaibel"
__version__ = "2020.08.24"

import rhinoscriptsyntax as rs
a = x.OutputCarriers[0].MonthlyCumulativeEnergy
# ---------- end python_10 ----------
panel_6 = Panel(hivemergersolartech)
ma_4 = MassAddition(Input=python_10.a)  # -> Result, PartialResults
graph = QuickGraph(python_10.a, SortOrder=0)
panel_7 = Panel(ma_4.Result)

# ----
# Heat Exchanger for District Heating
hivemergerhx = MergerHeatExchangerHive(
    DistrictHeating=hivedistenvironment.DistrictHeating,
    HeatDemand=sia380.Q_Heat,
    SuppTemp=python_8.monthlyHeatingSupTemp,
    ReturnTemp=python_8.monthlyHeatingReturnTemp,
    HeatExchanger=nickname.HiveIOEnergySystemsHeatExchanger)
panel_8 = Panel(hivemergerhx)

# ----
# Gas Boiler
hivemergerboiler = MergerGasBoilerHive(
    Gas=hivedistenvironment.NaturalGas,
    HeatDemand=sia380.Q_Heat,
    SuppTemp=python_8.monthlyHeatingSupTemp,
    HiveIOGasBoiler=nickname.HiveIOEnergySystemsBoiler)
panel_9 = Panel(hivemergerboiler)

# ----
# Air Source Heat Pump
hivemergerashp = MergerAirSourceHeatPumpHive(
    Air=hivedistenvironment.AmbientAirTemp,
    Electricity=hivedistenvironment.GridElectricity,
    HeatGenerated=sia380.Q_Heat,
    SuppTemp=python_8.monthlyHeatingSupTemp,
    SimpleMode=toggle_4,
    ASHP=nickname.HiveIOEnergySystemAirSourceHeatPump)
panel_10 = Panel(hivemergerashp)

# ----
# Heat Exchanger for District Cooling
hivemergercx = MergerCoolingExchangerHive(
    DistrictCooling=hivedistenvironment.DistrictCooling,
    CoolDemand=abs,
    SuppTemp=python_8.monthlyCoolingSupTemp,
    ReturnTemp=python_8.monthlyCoolingReturnTemp,
    CoolingExchanger=nickname.HiveIOEnergySystemsCoolExchanger)
panel_11 = Panel(hivemergercx)

# ----
# Chiller
hivemergerchiller = MergerChillerHive(
    Air=hivedistenvironment.AmbientAirTemp,
    Electricity=hivedistenvironment.GridElectricity,
    CoolingGenerated=abs,
    CondenserTemp=python_8.monthlyCoolingSupTemp,
    SimpleMode=toggle_4,
    Chiller=nickname.HiveIOEnergySystemChiller)
panel_12 = Panel(hivemergerchiller)

python_11 = GhPythonScript(chiller=hivemergerchiller, ashp=hivemergerashp, siaElec=sia380.Q_Elec)  # -> out, additionalElec; inputs siaElec: list
# ---------- python_11: Python ----------
__author__ = "Christoph"
__version__ = "2020.09.13"

import rhinoscriptsyntax as rs
if chiller != None and ashp != None:
    additionalElec = [a+b+c for a,b,c in zip(chiller.InputCarrier.MonthlyCumulativeEnergy, ashp.InputCarrier.MonthlyCumulativeEnergy, siaElec)]
elif ashp != None and chiller is None:
    additionalElec = [a+b for a,b in zip(ashp.InputCarrier.MonthlyCumulativeEnergy, siaElec)]
elif ashp is None and chiller != None:
    additionalElec = [a+b for a,b in zip(chiller.InputCarrier.MonthlyCumulativeEnergy, siaElec)]
else:
    additionalElec = siaElec
# ---------- end python_11 ----------
python_12 = GhPythonScript(pvOrSt=hivemergersolartech, elecDemandIn=python_11.additionalElec, heatDemandIn=sia380.Q_Heat)  # -> out, flatten(elecDemandOut), heatDemandOut; inputs elecDemandIn: list, heatDemandIn: list
# ---------- python_12: Python ----------
__author__ = "Christoph"
__version__ = "2020.09.13"

import rhinoscriptsyntax as rs
import Hive.IO.EnergySystems
if(pvOrSt != None):
    energyRenewable = pvOrSt.OutputCarriers[0].MonthlyCumulativeEnergy

if(type(pvOrSt) == Hive.IO.EnergySystems.Photovoltaic):
    elecDemandOut = [x - y for x, y in zip(elecDemandIn, energyRenewable)]
    heatDemandOut = heatDemandIn
elif(type(pvOrSt) == Hive.IO.EnergySystems.SolarThermal):
    heatDemandOut = [x - y for x, y in zip(heatDemandIn, energyRenewable)] 
    elecDemandOut = elecDemandIn
else:
    heatDemandOut = heatDemandIn
    elecDemandOut = elecDemandIn
# ---------- end python_12 ----------

# ----
# Purchased Grid Electricity for appliances
hivemergersubstation = MergerElectricalSubstationHive(
    GridElectricity=hivedistenvironment.GridElectricity,
    ElecPurchased=python_12.elecDemandOut,
    ElectricalSubstation=nickname.HiveIOEnergySystemElectricalSubstation)
panel_13 = Panel(hivemergersubstation)

# ----
# Plug-in any conversion tech
python_13 = GhPythonScript(x=hivemergerchiller)  # -> out, description, outEnergy
# ---------- python_13: Python ----------
__author__ = "chwaibel"
__version__ = "2020.08.18"

import rhinoscriptsyntax as rs

a = ("total investment cost: ", x.SpecificInvestmentCost * x.Capacity)
b = ("capacity: ", x.Capacity)
c = ("cap unit; ", x.CapacityUnit)
d = ("name: ", x.Name)
e = ("opCost CHF/a: ", sum(x.InputCarrier.TotalEnergyCost))
f = ("tot Input Energy kWh/a: ", sum(x.InputCarrier.Energy))
g = ("Tot Output Energy kWh/a: ", sum(x.OutputCarriers[0].MonthlyCumulativeEnergy))
h = ("Inp Car PEF: ", x.InputCarrier.PrimaryEnergyFactor)
description = [a, b, c, d, e, f, g, h]

# print(x.InputCarrier.MonthlyCumulativeEnergy)
#print(x.OutputCarriers[0].Energy)
print(x.InputCarrier.PrimaryEnergyFactor)
print("Input type: ", type(x.InputCarrier))
print("Output type: ", type(x.OutputCarriers[0]))
outEnergy = x.OutputCarriers[0].MonthlyCumulativeEnergy
print(x.IsCooling)
# ---------- end python_13 ----------
panel_14 = Panel(python_13.description)

# ----
# CHP
hivemergerchp = MergerCHPHive(
    Gas=hivedistenvironment.NaturalGas,
    EnergyDemand=sia380.Q_Elec,
    IsHeatingDemand=False,
    SuppTemp=python_8.monthlyHeatingSupTemp,
    HiveIOCombinedHeatPower=nickname.HiveIOEnergySystemsCombinedHeatPowert)
panel_15 = Panel(hivemergerchp)

# ----
# Results
hiveresults = ResultsHive(
    CoolingMonthly=abs,
    HeatingMonthly=python_12.heatDemandOut,
    ElectricityMonthly=python_12.elecDemandOut,
    HiveBuilding=hiveiodistr.HiveIOBuilding,
    HiveConversionTech=flatten([hivemergerboiler, hivemergerhx, hivemergercx, hivemergersolartech, hivemergersubstation, hivemergerchiller, hivemergerashp]),
    Q_T=sia380.Q_T_opaque,
    Q_V=sia380.Q_T_transparent,
    Q_i=sia380.Q_V,
    Q_s=sia380.Q_i,
    Q_s_2=sia380.Q_s,
    ConsumedElec=python_11.additionalElec,
    ConsumedHeat=sia380.Q_Heat)

hive_io_visualizer = HiveIOVisualizer(hiveresults)
python_14 = GhPythonScript(x=hiveresults)  # -> out, a
# ---------- python_14: Python ----------
__author__ = "chwaibel"
__version__ = "2020.09.23"

import rhinoscriptsyntax as rs
print("IN")
print("SolarGains: ", x.TotalSolarGains)
print("InternalGains: ", x.TotalInternalGains)
print("PrimaryEnergy: ", sum(x.TotalPrimaryEnergyMonthlyNonRenewable))
print("RenewableEnergy: ", sum(x.TotalFinalEnergyMonthlyRenewable))
print("OUT")
print("Electricity: ", sum(x.TotalConsumedElectricityMonthly))
print("VentilationLosses: ", x.TotalVentilationHeatLosses)
print("EnvelopeLosses: ", x.TotalOpaqueTransmissionHeatLosses)
print("WindowLosses: ", x.TotalWindowTransmissionHeatLosses)
print("SystemLosses: ", x.TotalSystemLosses)
print("ActiveCooling: ", sum(x.TotalActiveCoolingMonthly))
print("SurplusElectricity: ", sum(x.TotalFeedInElectricityMonthly))
print("SurplusHeating: ", sum(x.TotalSurplusHeatingMonthly))
print("Technologies")
print(x.ConversionTechnologies)

print(x.Building.Zones[0].HeatingLoadsMonthly)
# ---------- end python_14 ----------
panel_16 = Panel(python_14.out)
