# Grasshopper definition Hive_Merger_Test.gh (Grasshopper 1.0.7)
# plug-ins: HiveIO, solar-tech, sia380Parameters, solar, heatpumps, sia380, cooling, GHSolar, epw-reader, combustion

# ---- group: Pfad zur Wetterdatei (*.epw)
# EuKS2 - Heizwärmebedarf und PV Ertrag (simuliert)
# Berechnungen zur Abschätzung des Wärmebedarfs.
# Basiert auf der Excel Tabelle "Interaktion Struktur, Klima und Wärmebedarf.xlsx"
# 
# Sonneneinstrahlung simuliert gemäss "Waibel, C., Evins, R., Carmeliet, J. 2017. Efficient time-resolved 3D solar potential modelling. Solar Energy 158 (2017) 960–976."
panel = Panel("C:\EnergyPlusV8-5-0\WeatherData\USA_FL_Tampa.Intl.AP.722110_TMY3.epw")

# ----
rooms_standard = RoomsStandard({"1.1 Wohnen Mehrfamilienhaus": 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, "1.2 Wohnen Einfamilienhaus": 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, "2.1 Hotelzimmer": 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, "2.2 Empfang, Lobby": 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, "3.1 Einzel-, Gruppenbuero": {"description": "3.1 Einzel-, Gruppenbuero", "Raumlufttemperatur Auslegung Heizen (Winter)": 21.0, "Nettogeschossflaeche": 36.0, "Thermische Gebaeudehuellflaeche": 42.0, "U-Wert Fenster": 1.2, "Waermeeintragsleistung Personen (bei 24.0 deg C, bzw. 70 W)": 5.0, "Jaehrliche Vollaststunden der Geraete": 1930.0, "U-Wert opake Bauteile": 0.20000000000000001, "Jaehrliche Vollaststunden der Raumbeleuchtung": 1210.0, "Vollaststunden pro Jahr (Personen)": 1500.0, "Abminderungsfaktor fuer Fensterrahmen": 0.75, "Aussenluft-Volumenstrom durch Infiltration": 0.14999999999999999, "Raumlufttemperatur Auslegung Kuehlung (Sommer)": 26.0, "Glasanteil": 50.0, "Zeitkonstante": 117.0, "Waermeeintragsleistung der Raumbeleuchtung": 15.9, "Waermeeintragsleistung der Geraete": 7.0, "Gesamtenergiedurchlassgrad Verglasung": 0.5, "Temperatur-Aenderungsgrad der Waermerueckgewinnung": 0.69999999999999996, "Aussenluft-Volumenstrom (pro NGF)": 2.6000000000000001}, "3.2 Grossraumbuero": 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, "3.3 Sitzungszimmer": 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, "3.4 Schalterhalle, Empfang": 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, "4.1 Schulzimmer": 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, "4.2 Lehrerzimmer": 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}, selected="3.1 Einzel-, Gruppenbuero")
rooms_existing = RoomsExisting({"1.1 Wohnen Mehrfamilienhaus": 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, "1.2 Wohnen Einfamilienhaus": {"description": "1.2 Wohnen Einfamilienhaus", "Raumlufttemperatur Auslegung Heizen (Winter)": 21.0, "Nettogeschossflaeche": 20.0, "Thermische Gebaeudehuellflaeche": 38.0, "U-Wert Fenster": 1.5, "Waermeeintragsleistung Personen (bei 24.0 deg C, bzw. 70 W)": 1.3999999999999999, "Jaehrliche Vollaststunden der Geraete": 1780.0, "U-Wert opake Bauteile": 0.80000000000000004, "Jaehrliche Vollaststunden der Raumbeleuchtung": 1450.0, "Vollaststunden pro Jahr (Personen)": 4090.0, "Abminderungsfaktor fuer Fensterrahmen": 0.75, "Aussenluft-Volumenstrom durch Infiltration": 0.29999999999999999, "Raumlufttemperatur Auslegung Kuehlung (Sommer)": 26.0, "Glasanteil": 30.0, "Zeitkonstante": 56.0, "Waermeeintragsleistung der Raumbeleuchtung": 2.7000000000000002, "Waermeeintragsleistung der Geraete": 10.0, "Gesamtenergiedurchlassgrad Verglasung": 0.65000000000000002, "Temperatur-Aenderungsgrad der Waermerueckgewinnung": NaN, "Aussenluft-Volumenstrom (pro NGF)": 0.59999999999999998}, "2.1 Hotelzimmer": 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, "2.2 Empfang, Lobby": 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, "3.1 Einzel-, Gruppenbuero": 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, "3.2 Grossraumbuero": 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, "3.3 Sitzungszimmer": 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, "3.4 Schalterhalle, Empfang": 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, "4.1 Schulzimmer": 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, "4.2 Lehrerzimmer": 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}, selected="1.2 Wohnen Einfamilienhaus")
rooms_ideal = RoomsIdeal({"1.1 Wohnen Mehrfamilienhaus": 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, "1.2 Wohnen Einfamilienhaus": {"description": "1.2 Wohnen Einfamilienhaus", "Raumlufttemperatur Auslegung Heizen (Winter)": 21.0, "Nettogeschossflaeche": 20.0, "Thermische Gebaeudehuellflaeche": 38.0, "U-Wert Fenster": 0.90000000000000002, "Waermeeintragsleistung Personen (bei 24.0 deg C, bzw. 70 W)": 1.3999999999999999, "Jaehrliche Vollaststunden der Geraete": 1780.0, "U-Wert opake Bauteile": 0.10000000000000001, "Jaehrliche Vollaststunden der Raumbeleuchtung": 1110.0, "Vollaststunden pro Jahr (Personen)": 4090.0, "Abminderungsfaktor fuer Fensterrahmen": 0.75, "Aussenluft-Volumenstrom durch Infiltration": 0.14999999999999999, "Raumlufttemperatur Auslegung Kuehlung (Sommer)": 26.0, "Glasanteil": 30.0, "Zeitkonstante": 238.0, "Waermeeintragsleistung der Raumbeleuchtung": 1.7, "Waermeeintragsleistung der Geraete": 4.0, "Gesamtenergiedurchlassgrad Verglasung": 0.5, "Temperatur-Aenderungsgrad der Waermerueckgewinnung": 0.80000000000000004, "Aussenluft-Volumenstrom (pro NGF)": 0.59999999999999998}, "2.1 Hotelzimmer": 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, "2.2 Empfang, Lobby": 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, "3.1 Einzel-, Gruppenbuero": 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, "3.2 Grossraumbuero": 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, "3.3 Sitzungszimmer": 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, "3.4 Schalterhalle, Empfang": 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, "4.1 Schulzimmer": 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, "4.2 Lehrerzimmer": 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}, selected="1.2 Wohnen Einfamilienhaus")

# ---- group: PV Fläche
srf = Surface(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)

# ---- group: Boden
mesh = Mesh(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)

# ---- group: Gebäudevolumen
brep = Brep(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)

# ----
mesh_uv = MeshSurface(Surface=srf, UCount="6", VCount="6", Overhang=True, Equalize=False)

# ---- group: Umgebungsbebauung
mesh_2 = Mesh([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])

# ---- group: Fensterflächen
srf_2 = Surface([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])

# ----
hiveparainemitter = ParametricInputEmitterHive(Vorlauf="35", Rücklauf="25", Capacity="1000", InvestmentCost="1000", EmbodiedEmissions="1000")
hiveiosolar = HiveIOSolarTech(Mesh=mesh_uv, EmitterJson=hiveparainemitter)  # -> flatten(HiveIOEnergySystemSurfaceSystem), HiveIOEnergySystemsEmitter
hive_io_bldg = HiveIOBuilding(ZoneBrepGeometries=brep, WindowsSurfaces=srf_2, SIA2024Room_2=rooms_standard)
hive_io_env = HiveIOEnvironment(EPWPath=panel, ObstaclesGeometry=[mesh, mesh_2])
hiveiodistr = HiveIODistributor(HiveInputObjects=[hive_io_env, hive_io_bldg, hiveiosolar.HiveIOEnergySystemSurfaceSystem])  # -> HiveIOBuilding, HiveIOEnvironment, HiveIOEnergySystemSurfaceBasedTech, HiveIOEnergySystemConversionTech
python = GhPythonScript(investment_cost="1000", embodied_ghg="1000", capacity="1000")  # -> out, a, b
# ---------- python: Python ----------
__author__ = "Chris"
__version__ = "2020.08.05"

import rhinoscriptsyntax as rs
import Hive.IO.EnergySystems as hive

ashp = hive.AirSourceHeatPump(investment_cost, embodied_ghg, capacity, 3.5)
chiller = hive.Chiller(investment_cost, embodied_ghg, capacity, 3.5)

a = ashp

b = chiller
# ---------- end python ----------
nickname = GhDistributorConversionTech(HiveIOEnergySystemConversionTech=hiveiodistr.HiveIOEnergySystemConversionTech)  # -> HiveIOEnergySystemAirSourceHeatPump, HiveIOEnergySystemChiller
distrsolar = HiveIODistributorSolar(
    HiveIOBuilding=hiveiodistr.HiveIOBuilding,
    HiveIOEnergySystemSurfaceBased=hiveiodistr.HiveIOEnergySystemSurfaceBasedTech,
    HiveIOEnvironment=hiveiodistr.HiveIOEnvironment)  # -> EnvironmentMesh, BuildingCentroid, ExternalSurfaces, WindowGeometries, SolarTechMesh
hiveiodistrsupsys = HiveIODistributorSupplySystem(HiveIOEnergySystemsSurfaceBased=hiveiodistr.HiveIOEnergySystemSurfaceBasedTech)  # -> EfficiencyPV, PVAreas, EfficiencyST, STAreas, ElectricEfficiencyPVT, ThermalEfficiencyPVT, PVTAreas
distributorsia = DistributorSIA(BuildingObj=hiveiodistr.HiveIOBuilding)  # -> ZoneAreas, WindowsAreas, ExtSrfAreas, SIA2024json
hiveiodistrepw = HiveIODistributorEPW(HiveIOEnvironment=hiveiodistr.HiveIOEnvironment)
epw_reader = EPWReader(Path=hiveiodistrepw)  # -> Latitude, Longitude, CityCountry, GHI, DNI, DHI, DryBulb, DewPoint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
sia2024 = SIA2024Rooms(
    Room=distributorsia.SIA2024json,
    Area=distributorsia.ZoneAreas,
    Month=[1, 2, 3, 4, 5, 6, 7, 8, 9, 10, 11, 12],
    Season="winter")  # -> Τ_h, Θ_i_C, T_h, A_op_m2, A_w_m2, U_op_W_m2K, U_w_W_m2K, V_e_m3_h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
adaptcomf = AdaptiveComfort(T_m=epw_reader.DryBulbMonthly)  # -> T_n, T_n80ub, T_n80lb, T_n90ub, T_n90lb

# ----
# PV Ertrag (simuliert)
data = Data([0.8, 0.8, 0.8, 0.8, 0.8, 0.8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])
mesh_3 = Mesh(distrsolar.ExternalSurfaces)
obstobj = ObstacleObject(Mesh=distrsolar.SolarTechMesh, Albedo=data, SpecCoeff=data, ReflType=0, Tolerance=0.01, Name="PV", MT=True)
obstobj_2 = ObstacleObject(Mesh=[distrsolar.EnvironmentMesh, mesh_3], Albedo=data, SpecCoeff=data, ReflType=0, Tolerance=0.01, Name="PV", MT=True)
irrmshy = IrradiationMeshYear(
    AnalysisObjects=obstobj,
    ObstacleObjects=obstobj_2,
    Latitude=epw_reader.Latitude,
    Longitude=epw_reader.Longitude,
    Year=2017,
    DNI=epw_reader.DNI,
    DHI=epw_reader.DHI,
    MainSkyRes=1,
    SpecBounces=0,
    DiffIReflSkyRes=0,
    DiffIReflMode=2,
    MT=True)
readresults = ReadResults(Mesh=distrsolar.SolarTechMesh, I=irrmshy, Value=7)  # -> Results, SP
visumshsol = VisualizeMeshSolar(Mesh=distrsolar.SolarTechMesh, I=irrmshy, Value=0)
python_2 = GhPythonScript(x=simplify(readresults.Results), month=[0, 1, 2, 3, 4, 5, 6, 7, 8, 9, 10, 11])  # -> out, a; inputs x: list, month: Int32
# ---------- python_2: Python ----------
__author__ = "chwaibel"
__version__ = "2020.02.25"

import rhinoscriptsyntax as rs

# 8760 time series
# get monthly average...
# how to know how many days a month? somewhere, I have typical year.
# in some honey-badger script

dayspermonth = [31.0, 28.0, 31.0, 30.0, 31.0, 30.0, 31.0, 31.0, 30.0, 31.0, 30.0, 31.0]

hour_per_day = 24
start_hour = int(hour_per_day * sum(dayspermonth[0:month])) 
end_hour = int(hour_per_day * sum(dayspermonth[0:month+1]))

cumulative_data = sum(x[start_hour:end_hour])

a = cumulative_data / 1000
# ---------- end python_2 ----------
c_script = CSharpScript(G=python_2.a, g=hiveiodistrsupsys.EfficiencyPV)  # -> out, Q_s; inputs G: tree of Double, g: list of Double
# ---------- c_script: C# ----------
    int winCount = G.BranchCount;
    double [] Q_array = new double[12];

    DataTree<double> doubleTree = new DataTree<double>();
    for (int i = 0; i < G.BranchCount; i++)
    {
      for (int j = 0; j < G.Branch(i).Count; ++j) // should be 12, 1 for each month of the year
      {
        GH_Path path = new GH_Path(i, j);
        double irrad = G.Branch(i)[j]  * g[i];
        doubleTree.Add(irrad, path);

        Q_array[j] += irrad;
      }
    }

    Q_s = Q_array;
# ---------- end c_script ----------
ma = MassAddition(Input=c_script.Q_s)  # -> Result, PartialResults
ma_2 = MassAddition(Input=hiveiodistrsupsys.PVAreas)  # -> Result, PartialResults
division = Division(A=ma.Result, B=ma_2.Result)

# ----
# Solare Wärmeeinträge
mesh_4 = MeshBrep(
    Brep=distrsolar.WindowGeometries,
    Settings={GridMaxCount=0, GridMinCount=16, JaggedSeams=False, MaxEdgeLength=0, MinEdgeLength=0.0001, MinTolerance=0, Refine=True, RefineAngle=0, RelativeTolerance=0.65, SimplePlanes=True, Tolerance=0})
obstobj_3 = ObstacleObject(Mesh=mesh_4, Albedo=data, SpecCoeff=data, ReflType=0, Tolerance=0.01, Name="PV", MT=True)
irrmshy_2 = IrradiationMeshYear(
    AnalysisObjects=obstobj_3,
    ObstacleObjects=obstobj_2,
    Latitude=epw_reader.Latitude,
    Longitude=epw_reader.Longitude,
    Year=2017,
    DNI=epw_reader.DNI,
    DHI=epw_reader.DHI,
    MainSkyRes=1,
    SpecBounces=0,
    DiffIReflSkyRes=0,
    DiffIReflMode=2,
    MT=True)
item = ListItem(List=sia2024.G_, Index=0, Wrap=True)
readresults_2 = ReadResults(Mesh=mesh_4, I=irrmshy_2, Value=7)  # -> simplify(Results), SP
python_3 = GhPythonScript(x=simplify(readresults_2.Results), month=[0, 1, 2, 3, 4, 5, 6, 7, 8, 9, 10, 11])  # -> out, a; inputs x: list, month: Int32; same code as python_2
c_script_2 = CSharpScript(G=python_3.a, g=item)  # -> out, Q_s; inputs G: tree of Double, g: Double
# ---------- c_script_2: C# ----------
    int winCount = G.BranchCount;
    double [] Q_array = new double[12];

    DataTree<double> doubleTree = new DataTree<double>();
    for (int i = 0; i < G.BranchCount; i++)
    {
      for (int j = 0; j < G.Branch(i).Count; ++j) // should be 12, 1 for each month of the year
      {
        GH_Path path = new GH_Path(i, j);
        double irrad = G.Branch(i)[j] *  g;
        doubleTree.Add(irrad, path);

        Q_array[j] += irrad;
      }
    }

    Q_s = Q_array;
# ---------- end c_script_2 ----------
panel_2 = Panel(c_script_2.Q_s)

# ----
# SOLAR SIMULATION
# Solare Wärmeeinträge
# Q_s = G * F_F * A_w * g
# [Q_s] = kWh
# [G] = kWh/m^2
# [F_F] = -
# [A_w] = m^2
# [g] = -
c_script_3 = CSharpScript(x=distrsolar.WindowGeometries)  # -> out, tilt, azimuth, area; inputs x: Brep
# ---------- c_script_3: C# ----------
    Surface srf = x.Surfaces[0];

    AreaMassProperties massProp = AreaMassProperties.Compute(srf);
    Point3d cen = massProp.Centroid;
    double u,v;
    srf.ClosestPoint(cen, out u, out v);
    Vector3d normal = srf.NormalAt(u, v);

    if(x.Faces[0].OrientationIsReversed)
      normal.Reverse();

    Vector3d vnormal = new Vector3d(0, 0, 1);
    Vector3d tiltZ0 = new Vector3d(0, 0, 1);

    double tiltValue = Vector3d.VectorAngle(normal, tiltZ0, vnormal);
    tilt = tiltValue * (180.0 / Math.PI);

    double azimuthValue = Vector3d.VectorAngle(new Vector3d(normal.X, normal.Y, 0), new Vector3d(0, 1, 0), vnormal);
    azimuth = azimuthValue * (180 / Math.PI);

//    Line normalLine = new Line(cen, cen + normal);
//    Line azimuthLine = new Line(cen, cen + new Vector3d(0, 1, 0));
//    Line tiltLine = new Line(cen, cen + tiltZ0);
//    A = normalLine;
//    B = azimuthLine;
//    C = tiltLine;


    area = AreaMassProperties.Compute(x.Faces[0]).Area;
# ---------- end c_script_3 ----------
simplepanel = SimplePanel(
    Tilt=c_script_3.tilt,
    Azimuth=c_script_3.azimuth,
    DHI=epw_reader.DHI,
    DNI=epw_reader.DNI,
    Latitude=epw_reader.Latitude,
    Longitude=epw_reader.Longitude)
python_4 = GhPythonScript(x=simplify(simplepanel), month=[0, 1, 2, 3, 4, 5, 6, 7, 8, 9, 10, 11])  # -> out, a; inputs x: list, month: Int32; same code as python_2
c_script_4 = CSharpScript(G=python_4.a, A_w=c_script_3.area, g=item)  # -> out, Q_s; inputs G: tree of Double, A_w: list of Double, g: Double
# ---------- c_script_4: C# ----------
    int winCount = G.BranchCount;
    double [] Q_array = new double[12];

    DataTree<double> doubleTree = new DataTree<double>();
    for (int i = 0; i < G.BranchCount; i++)
    {
      for (int j = 0; j < G.Branch(i).Count; ++j) // should be 12, 1 for each month of the year
      {
        GH_Path path = new GH_Path(i, j);
        double irrad = G.Branch(i)[j] * A_w[i] * g;
        doubleTree.Add(irrad, path);

        Q_array[j] += irrad;
      }
    }

    Q_s = Q_array;
# ---------- end c_script_4 ----------
panel_3 = Panel(c_script_4.Q_s)

# ---- group: NEW SIA 380 COMPONENT / unobstructed
c_script_5 = CSharpScript(G=python_4.a, A_w=c_script_3.area, g=item)  # -> out, Q_s; inputs G: tree of Double, A_w: list of Double, g: Double
# ---------- c_script_5: C# ----------
    int winCount = G.BranchCount;
    double [][] Q_array = new double[12][];
    for(int j = 0; j < G.Branch(0).Count; j++)
      Q_array[j] = new double[G.BranchCount];

    DataTree<double> doubleTree = new DataTree<double>();
    for (int i = 0; i < G.BranchCount; i++)
    {
      for (int j = 0; j < G.Branch(i).Count; ++j) // should be 12, 1 for each month of the year
      {
        GH_Path path = new GH_Path(i, j);
        double irrad = G.Branch(i)[j] * A_w[i] * g;
        doubleTree.Add(irrad, path);

        Q_array[j][i] = irrad*1000;
      }
    }

    jagged output = new jagged();
    output.data = Q_array;
    Q_s = output;
# ---------- c_script_5: C# additional code ----------
  public struct jagged
  {
    public double [][] data;
  }
# ---------- end c_script_5 ----------

# ---- group: NEW SIA 380 COMPONENT / obstructed
c_script_6 = CSharpScript(G=python_3.a, g=item)  # -> out, Q_s; inputs G: tree of Double, g: Double
# ---------- c_script_6: C# ----------
    int winCount = G.BranchCount;
    double [][] Q_array = new double[12][];
    for(int j = 0; j < G.Branch(0).Count; j++)
      Q_array[j] = new double[G.BranchCount];

    DataTree<double> doubleTree = new DataTree<double>();
    for (int i = 0; i < G.BranchCount; i++)
    {
      for (int j = 0; j < G.Branch(i).Count; ++j) // should be 12, 1 for each month of the year
      {
        GH_Path path = new GH_Path(i, j);
        double irrad = G.Branch(i)[j] * g;
        doubleTree.Add(irrad, path);

        Q_array[j][i] = irrad*1000;
      }
    }
    jagged jag = new jagged();
    jag.data = Q_array;

    Q_s = jag;
# ---------- c_script_6: C# additional code ----------
  public struct jagged
  {
    public double [][] data;
  }
# ---------- end c_script_6 ----------

# ----
# Energy Hub
panel_4 = Panel("0.27")

# ----
# PV / ST
panel_5 = Panel("hourly")
solartechsetoutputs = SolarTechSetOutputs(
    GHSolar_CResults=irrmshy,
    Hive_SurfaceBased=hiveiodistr.HiveIOEnergySystemSurfaceBasedTech,
    Amb_T_carrier=epw_reader.AmbientTemperatureCarrier,
    Return_water_carrier=hiveiosolar.HiveIOEnergySystemsEmitter,
    TimeResolution=panel_5)
python_5 = GhPythonScript(x=solartechsetoutputs)  # -> out, pvHourly, pvMonthly, solarPot, inletWater, ambientAir, panelArea
# ---------- python_5: Python ----------
__author__ = "Christoph"
__version__ = "2020.07.06"

import rhinoscriptsyntax as rs

import Hive.IO.EnergySystems as ensys

pvHourly = x.OutputCarriers[0].AvailableEnergy

pvMonthly = x.OutputCarriers[0].MonthlyCumulativeEnergy

solarPot = x.InputCarrier.AvailableEnergy
if isinstance(x, ensys.SolarThermal):
    inletWater = x.InletWater.SupplyTemperature
ambientAir = x.AmbientAir.AvailableEnergy
panelArea = x.SurfaceArea
# ---------- end python_5 ----------
panel_6 = Panel(solartechsetoutputs)
panel_7 = Panel(python_5.pvMonthly)

graph = QuickGraph(panel_7, SortOrder=0)
python_6 = GhPythonScript(x="0.95")  # -> out, a
# ---------- python_6: Python ----------
__author__ = "chwaibel"
__version__ = "2020.08.12"

import rhinoscriptsyntax as rs

horizon = 12

a = [x] * horizon
# ---------- end python_6 ----------
python_7 = GhPythonScript(x="0.27")  # -> out, a; same code as python_6
python_8 = GhPythonScript(x="0.209")  # -> out, a; same code as python_6

# ---- group: NEW SIA 380 COMPONENT
# DEMAND MODELING
panel_8 = Panel("""transp
transp
transp
transp
transp
opaque""")
subtraction = Subtraction(A=distributorsia.ExtSrfAreas, B=distributorsia.WindowsAreas)
merge = Merge(Data1=c_script_3.area, Data2=subtraction)  # -> flatten(Result)
sia380 = SIA380(
    Room_properties=distributorsia.SIA2024json,
    Floor_area=distributorsia.ZoneAreas,
    T_e=epw_reader.DryBulbMonthly,
    Setpoints_ub=adaptcomf.T_n90ub,
    Setpoints_lb=adaptcomf.T_n90lb,
    Surface_areas=merge,
    Surface_type=panel_8,
    Q_s_per_surface=c_script_6.Q_s)  # -> Q_Heat, Q_Cool, Q_Elec, Q_T, Q_V, Q_i, Q_s
ma_3 = MassAddition(Input=sia380.Q_Heat)  # -> Result, PartialResults
division_2 = Division(A=ma_3.Result, B=distributorsia.ZoneAreas)

# ---- group: NEW SIA 380 COMPONENT / providing heat with heatpump
simple_hp = SimpleHp(Q_th=sia380.Q_Heat, COP="3.5")
ma_4 = MassAddition(Input=simple_hp)  # -> Result, PartialResults
division_3 = Division(A=ma_4.Result, B=distributorsia.ZoneAreas)

# ---- group: NEW SIA 380 COMPONENT (continued)
python_9 = GhPythonScript(x=sia380.Q_Elec, y=simple_hp)  # -> out, a; inputs x: list, y: list
# ---------- python_9: Python ----------
__author__ = "Christoph"
__version__ = "2020.05.20"

import rhinoscriptsyntax as rs
elec = []
for i in range(len(x)):
    elec.append(x[i] + y[i])

a = elec
# ---------- end python_9 ----------

# ----
# Air Source Heat Pump
# Electricity carrier has information on how much electricity is consumed by this heat pump.
# 
# But where should this Carrier be created?
# 
# Hive.IO.Environment?
# cost is electricity times grid price
# 
# ghg is electricity times grid EF
# ASHP object from distributor
python_10 = GhPythonScript(electricityConsumed=simple_hp, EF="0.209", price=panel_4)  # -> out, ElectricityCarrier, ghg, cost; inputs electricityConsumed: list
# ---------- python_10: Python ----------
__author__ = "Christoph"
__version__ = "2020.08.06"
from System import Array
import rhinoscriptsyntax as rs
import Hive.IO.EnergySystems as hive

energyCost = [i * price for i in electricityConsumed]
ghgEmissions = [i * EF for i in electricityConsumed]

ElectricityCarrier = hive.Electricity(electricityConsumed.Count, Array[float](electricityConsumed), Array[float](energyCost), Array[float](ghgEmissions))
ghg = ghgEmissions
cost = energyCost
# ---------- end python_10 ----------
python_11 = GhPythonScript(emitter=hiveiosolar.HiveIOEnergySystemsEmitter)  # -> out, a, b
# ---------- python_11: Python ----------
__author__ = "Chris"
__version__ = "2020.08.05"

import rhinoscriptsyntax as rs
import Hive.IO.EnergySystems as hive

sup_temp = emitter.ReturnCarrier.SupplyTemperature

a = sup_temp

b = emitter.ReturnCarrier.MonthlySupplyTemperature;
# ---------- end python_11 ----------
nickname_2 = GhMergerHeatPump(
    Air=epw_reader.AmbientTemperatureCarrier,
    Electricity=python_10.ElectricityCarrier,
    Horizon="12",
    HeatGenerated=sia380.Q_Heat,
    Cost=python_10.cost,
    Ghg=python_10.ghg,
    SuppTemp=python_11.b,
    ASHP=python.a)
panel_9 = Panel(nickname_2)

# ----
# Chiller
# convert to monthly temperatures first
abs = Absolute(Value=sia380.Q_Cool)
python_12 = GhPythonScript(x=epw_reader.AmbientTemperatureCarrier)  # -> out, a
# ---------- python_12: Python ----------
__author__ = "chwaibel"
__version__ = "2020.08.12"

import rhinoscriptsyntax as rs

a = x.AvailableEnergy
# ---------- end python_12 ----------
python_13 = GhPythonScript(x=panel_4)  # -> out, a; same code as python_6
panel_10 = Panel("Need a cooling emitter")
python_14 = GhPythonScript(x="0.209")  # -> out, a; same code as python_6
chiller_tr = ChillerTr(Cooling_loads=abs, Elec_cost=python_13.a, Elec_emissions=python_14.a, Temperature=python_12.a)  # -> Elec, Cost, Carbon, COP
python_15 = GhPythonScript(electricityConsumed=chiller_tr.Elec, EF="0.209", price=panel_4)  # -> out, ElectricityCarrier, ghg, cost; inputs electricityConsumed: list; same code as python_10
hivemergerchiller = MergerChillerHive(
    Air=epw_reader.AmbientTemperatureCarrier,
    Electricity=python_15.ElectricityCarrier,
    Horizon="12",
    CoolingGenerated=abs,
    Cost=chiller_tr.Cost,
    Ghg=chiller_tr.Carbon,
    SuppTemp=python_11.b,
    Chiller=python.b)
panel_11 = Panel(hivemergerchiller)

boiler = Boiler(Heating_loads=sia380.Q_Heat, Carrier_cost="0.209", Carrier_emissions="0.27", Efficiency="0.95")  # -> Cost, Carbon
boiler_tr = BoilerTr(Heating_loads=sia380.Q_Heat, Carrier_cost=python_8.a, Carrier_emissions=python_7.a, Efficiency=python_6.a)  # -> Cost, Carbon
python_16 = GhPythonScript(gasConsumed=sia380.Q_Heat, EF="0.27", price="0.209")  # -> out, GasCarrier, ghg, cost; inputs gasConsumed: list; same code as python_10
hivemergerboiler = MergerGasBoilerHive(Cost=boiler_tr.Cost, Ghg=boiler_tr.Carbon)
data_2 = Data([ma_3.Result, ma_4.Result, ma.Result, division_2, division_3, division])

# ----
# Results
hiveresults = ResultsHive(
    CoolingMonthly=sia380.Q_Cool,
    HeatingMonthly=sia380.Q_Heat,
    ElectricityMonthly=sia380.Q_Elec,
    HiveBuilding=hiveiodistr.HiveIOBuilding)
hive_io_visualizer = HiveIOVisualizer(hiveresults)

# ---- group: Heizwärmebedarf, Strombedarf Wärmepumpe und Stromertrag PV
# Jahresheizwärmebedarf in kWh
# Jahresstrombedarf Wärmepumpe in kWh
# Jahresstromertrag PV in kWh
# Jahresheizwärmebedarf in kWh/m^2
# Jahresstrombedarf Wärmepumpe in kWh/m^2
# Jahresstromertrag PV in kWh/m^2 PV
panel_12 = Panel(data_2)
