# Grasshopper definition EaCS3_E04_Hive_Template.gh (Grasshopper 1.0.7)
# plug-ins: HiveIO, Hive.Core.sia380, GHSolar

panel = Panel("C:\Users\chwaibel\Documents\Github\hive\GrasshopperExamples\LectureExercises\HIVE_Zurich.epw")

# ---- group: Path to weather file (.epw)
panel_2 = Panel("\\Mac\Home\Documents\GitHub\hive\GrasshopperExamples\LectureExercises\HIVE_Zurich.epw")

# ---- group: refine windows discretisation
panel_3 = Panel("4")
panel_4 = Panel("10")

# ----
srf = Surface(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)

# ---- group: PV Fläche
srf_2 = Surface(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)

# ---- group: static shading
mesh = Mesh(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)

# ---- group: Ground
mesh_2 = Mesh(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)

# ---- group: Context (City, obstacles, etc.)
mesh_3 = Mesh([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])

# ---- group: Windows
srf_3 = Surface([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])

# ---- group: Building volume
brep = Brep(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)

# ----
mesh_uv = MeshSurface(Surface=[srf_2, srf], UCount="6", VCount="6", Overhang=True, Equalize=False)

# ---- group: Hive model description
hiveinputenergysystems = InputEnergySystemsHive(
    MeshSolarTechnologyProperties=mesh_uv,
    conversions="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",
    emitters="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",
    meshConnections="""{
  "$type": "System.Collections.Generic.Dictionary`2[[System.Int32, mscorlib],[System.Int32, mscorlib]], mscorlib",
  "0": 1,
  "1": 0
}""",
    meshes="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")  # -> flatten(HiveEnergySystems)
hiveinputenvironment = InputEnvironmentHive(EpwPath=panel, ObstacleGeometries=[mesh_2, mesh_3, mesh])

# ----
hiveinputbuilding = InputBuildingHive(ZoneGeometry=brep, WindowsSurfaces=srf_3, SiaRoom="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")
run_hive = BooleanToggle(True)
hivedistributor = MainDistributorHive(HiveInputs=[hiveinputenvironment, hiveinputbuilding, hiveinputenergysystems, run_hive])  # -> HiveBuilding, HiveEnvironment, HiveEnergySystemsSurfaceBasedTech, HiveEnergySystemsConversionTech, HiveEnergySystemsEmitter
hiveresultstype = HiveResultsType({"Cost - Lifetime Embodied": TotalCostEmbodied, "Cost - Lifetime Embodied Construction": TotalCostEmbodiedConstruction, "Cost - Lifetime Embodied Systems": TotalCostEmbodiedSystems, "Cost - Lifetime Operational": TotalCostOperational, "Cost - Lifetime Operational Construction": TotalCostOperationalConstruction, "Cost - Lifetime Operational Systems": TotalCostOperationalSystems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}, selected="Cost - Monthly Operational Systems": TotalCostOperationalSystemsMonthly)

# ---- group: shading mask rec level
toggle = BooleanToggle(False)
number_slider = Slider(3, range=0..5)
number_slider_2 = Slider(0.113, range=0..2)

# ---- group: sun vector HOY
toggle_2 = BooleanToggle(False)
number_slider_3 = Slider(2680, range=0..8759)

# ---- group: show sunpath
toggle_3 = BooleanToggle(False)

# ---- group: Simulate solar?
toggle_4 = BooleanToggle(False)

# ---- group: min (blue) to max (yellow) irradiation (kWh/m^2)
number_slider_4 = Slider(0, range=0..1000)
number_slider_5 = Slider(930.703, range=0..2000)

# ----
# Distributor
hivedistsolarsimu = DistributorSolarSimulationHive(
    HiveBuilding=hivedistributor.HiveBuilding,
    HiveSolarTechnologies=hivedistributor.HiveEnergySystemsSurfaceBasedTech,
    HiveEnvironment=hivedistributor.HiveEnvironment)  # -> EnvironmentMesh, BuildingCentroid, ExternalSurfaces, WindowGeometries, WindowTilt, WindowAzimuth, WindowAreas, SolarTechMesh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
hivedistconversiontech = DistributorConversionTechHive(ConversionTechnologies=hivedistributor.HiveEnergySystemsConversionTech)  # -> AirSourceHeatPump, Chiller, Boiler, CombinedHeatAndPower, HeatExchanger, ColdExchanger, DirectElectricity
hivedistenvironment = DistributorEnvironmentHive(HiveEnvironment=hivedistributor.HiveEnvironment)  # -> EPW, NaturalGas, BioGas, WoodPellets, DistrictHeating, DistrictCooling, GridElectricity, AmbientAirTemp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
hivedistsiaroom = DistributorSIARoomHive(HiveBuilding=hivedistributor.HiveBuilding)  # -> ZoneAreas, WindowsAreas, ExternalSurfacesAreas, SIA2024Room, AllExternalSurfaceAreas, SurfaceType, SUA2024Schedules, UseAdaptiveComfort, UseNaturalVentilation, UseFixedTimeConstant
hivedistemitter = DistributorEmitterHive(Emitters=hivedistributor.HiveEnergySystemsEmitter)  # -> HourlyHtgSupTemp, HourlyHtgRetTemp, HourlyClgSupTemp, HourlyClgRetTemp
bool = Boolean(toggle_4)
python = GhPythonScript(x=hivedistsolarsimu.WindowGeometries, y=bool)  # -> out, a
# ---------- python: Python ----------
__author__ = "chwaibel"
__version__ = "2020.09.09"

import rhinoscriptsyntax as rs

if y:
    a = x
# ---------- end python ----------
python_2 = GhPythonScript(x=hivedistsolarsimu.SolarTechMesh, y=toggle_4)  # -> out, a; same code as python
hivedistepw = DistributorEPW(EPW=hivedistenvironment.EPW, WriteGHNumbers=Toggle(True))  # -> EPW, Latitude, Longitude, CityCountry, GHI, DNI, DHI, DryBulb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
sia2024room = SIA2024RoomReader(Room=hivedistsiaroom.SIA2024Room, Area=hivedistsiaroom.ZoneAreas)  # -> Τ_h, Θ_i_C, T_h, A_op_m2, A_w_m2, U_op_W_m2K, U_w_W_m2K, V_e_m3_h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
adaptivecomfort = AdaptiveComfort(AirTemperature=hivedistepw.DryBulb)  # -> ThermalComfort, Comfort80UpperBound, Comfort80LowerBound, Comfort90UpperBound, Comfort90LowerBound

# ---- group: Upper temperature setpoint (°C)
panel_5 = Panel(adaptivecomfort.Comfort80UpperBound)

# ---- group: Lower temperature setpoint (°C)
panel_6 = Panel(adaptivecomfort.Comfort80LowerBound)

# ---- group: Monthly average dry bulb temperature (°C)
panel_7 = Panel(hivedistepw.DryBulbMonthly)

# ---- group: checking windows order
item = ListItem(List=hivedistsolarsimu.WindowGeometries, Index=Slider(0, range=0..5), Wrap=True)
offset = OffsetSurface(Surface=item, Distance=0.5, Retrim=True)
preview = CustomPreview(Geometry=offset, Shader=ColourSwatch(SwatchColor=RGB(74, 207, 255)))

# ----
graph = QuickGraph([panel_5, panel_6, panel_7], SortOrder=0)

# ---- group: DHI
data = Data(hivedistepw.DHI)

# ----
# Shading Mask
dni = Data(hivedistepw.DNI)
panel_8 = Panel([hivedistepw.Longitude, hivedistepw.Latitude])
pt = Point(hivedistsolarsimu.BuildingCentroid)
skydome = GHSkydome(
    RecursionLevel=number_slider,
    Viewfactors=toggle,
    CumSkyMatrix=Toggle(False),
    SunPath=toggle_3,
    SolarVec=toggle_2,
    HOY=number_slider_3,
    Location=panel_8,
    DNI=dni,
    DHI=data,
    Size=number_slider_2,
    Context=hivedistsolarsimu.EnvironmentMesh,
    Sp=pt,
    Timezone=hivedistepw.Timezone)  # -> Mesh, Vectors, Sunpaths, SunGeo
mesh_4 = Mesh(skydome.Mesh)
preview_2 = CustomPreview(Geometry=skydome.Sunpaths, Shader=ColourSwatch(SwatchColor=RGB(0, 0, 0)))

# ----
# SOLAR SIMULATION
num = Number(number_slider_5)
num_2 = Number(number_slider_4)
mesh_5 = Mesh(hivedistsolarsimu.ExternalSurfaces)
data_2 = Data([0.8, 0.8, 0.8, 0.8, 0.8, 0.8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])
obstobj = ObstacleObject(
    Mesh=[hivedistsolarsimu.EnvironmentMesh, mesh_5],
    Albedo=data_2,
    SpecCoeff=data_2,
    ReflType=0,
    Tolerance=0.01,
    Name="PV",
    MT=True)

# ----
# Solare Wärmeeinträge (shaded)
mesh_uv_2 = MeshSurface(Surface=python.a, UCount=panel_3, VCount=panel_4, Overhang=True, Equalize=False)  # -> flatten(Mesh)
mesh_6 = Mesh(mesh_uv_2)
obstobj_2 = ObstacleObject(Mesh=mesh_6, Albedo=data_2, SpecCoeff=data_2, ReflType=0, Tolerance=0.01, Name="PV", MT=True)
irrmshy = IrradiationMeshYear(
    AnalysisObjects=obstobj_2,
    ObstacleObjects=obstobj,
    Latitude=hivedistepw.Latitude,
    Longitude=hivedistepw.Longitude,
    Year=2017,
    DNI=hivedistepw.DNI,
    DHI=hivedistepw.DHI,
    MainSkyRes=1,
    SpecBounces=0,
    DiffIReflSkyRes=0,
    DiffIReflMode=2,
    MT=True,
    Timezone=hivedistepw.Timezone)
readresults = ReadResults(Mesh=mesh_6, I=irrmshy, Value=7)  # -> simplify(Results), SP
visumshsol = VisualizeMeshSolar(Mesh=mesh_6, I=irrmshy, Value=0, Min=num_2, Max=num, Clr=0)

# ---- group: Windows
mesh_7 = Mesh(visumshsol)

# ----
# Solare Wärmeeinträge (unshaded)
solarpotentialsunobstructed = SolarPotentialsUnobstructed(
    Tilt=hivedistsolarsimu.WindowTilt,
    Azimuth=hivedistsolarsimu.WindowAzimuth,
    DHI=hivedistepw.DHI,
    DNI=hivedistepw.DNI,
    Latitude=hivedistepw.Latitude,
    Longitude=hivedistepw.Longitude,
    Aw=hivedistsolarsimu.WindowAreas,
    Timezone=hivedistepw.Timezone)

# ---- group: hourly demand?
toggle_5 = BooleanToggle(False)

# ----
# PV Ertrag (simuliert)
obstobj_3 = ObstacleObject(Mesh=python_2.a, Albedo=data_2, SpecCoeff=data_2, ReflType=0, Tolerance=0.01, Name="PV", MT=True)
irrmshy_2 = IrradiationMeshYear(
    AnalysisObjects=obstobj_3,
    ObstacleObjects=obstobj,
    Latitude=hivedistepw.Latitude,
    Longitude=hivedistepw.Longitude,
    Year=2017,
    DNI=hivedistepw.DNI,
    DHI=hivedistepw.DHI,
    MainSkyRes=1,
    SpecBounces=0,
    DiffIReflSkyRes=0,
    DiffIReflMode=2,
    MT=True,
    Timezone=0)
visumshsol_2 = VisualizeMeshSolar(Mesh=hivedistsolarsimu.SolarTechMesh, I=irrmshy_2, Value=0, Min=num_2, Max=num)

# ---- group: PV Panels
mesh_8 = Mesh(visumshsol_2)

# ---- group: NEW SIA 380 COMPONENT
# DEMAND
sia380 = BuildingDemandSIA380(
    RoomProperties=hivedistsiaroom.SIA2024Room,
    RoomSchedules=hivedistsiaroom.SUA2024Schedules,
    FloorArea=hivedistsiaroom.ZoneAreas,
    AirTemperature=hivedistepw.DryBulb,
    SetpointsUpperBounds=adaptivecomfort.Comfort80UpperBound,
    SetpointsLowerBounds=adaptivecomfort.Comfort80LowerBound,
    EnvelopeSurfaceAreas=hivedistsiaroom.AllExternalSurfaceAreas,
    EnvelopeSurfaceTypes=hivedistsiaroom.SurfaceType,
    SurfaceIrradiation=readresults.Results,
    SurfaceIrradiationUnobstructed=solarpotentialsunobstructed,
    GValue=sia2024room.G_,
    GValueWithSunscreen=sia2024room.G_total_,
    SetpointSunscreen=sia2024room.G_T_W_m_2,
    RunObstructedSolarSimulation=bool,
    RunHourly=toggle_5,
    UseAdaptiveComfort=hivedistsiaroom.UseAdaptiveComfort,
    UseNaturalVentilation=hivedistsiaroom.UseNaturalVentilation,
    UseFixedTimeConstant=hivedistsiaroom.UseFixedTimeConstant)  # -> HeatingDemand, DomesticHotWaterDemand, CoolingDemand, ElectricityDemand, TransmissionHeatLosses, VentilationHeatLosses, InternalGains, SolarGains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
abs = Absolute(Value=sia380.CoolingDemand)

# ----
# PV Ertrag (unverschattet)
# Q_s = G * F_F * A_w * g
# [Q_s] = kWh
# [G] = kWh/m^2
# [F_F] = -
# [A_w] = m^2
# [g] = -
solarpotentialsunobstructed_2 = SolarPotentialsUnobstructed(
    Tilt=hivedistsolarsimu.SolarTechTilt,
    Azimuth=hivedistsolarsimu.SolarTechAzimuth,
    DHI=hivedistepw.DHI,
    DNI=hivedistepw.DNI,
    Latitude=hivedistepw.Latitude,
    Longitude=hivedistepw.Longitude,
    Aw=1,
    Timezone=0)

# ---- group: Simple efficiency calculations?
toggle_6 = BooleanToggle(False)

# ----
# Chiller
hivemergerchiller = MergerChillerHive(
    AirCarrier=hivedistenvironment.AmbientAirTemp,
    ElectricityCarrier=hivedistenvironment.GridElectricity,
    CoolingGenerated=abs,
    SupplyTemperature=hivedistemitter.HourlyClgSupTemp,
    SimpleMode=toggle_6,
    HiveChiller=hivedistconversiontech.Chiller)

# ----
# Air Source Heat Pump
hivemergerashp = MergerAirSourceHeatPumpHive(
    AirCarrier=hivedistenvironment.AmbientAirTemp,
    ElectricityCarrier=hivedistenvironment.GridElectricity,
    HeatingGenerated=sia380.HeatingDemand,
    SupplyTemperature=hivedistemitter.HourlyHtgSupTemp,
    SimpleMode=toggle_6,
    HiveAirSourceHeatPump=hivedistconversiontech.AirSourceHeatPump)

# ----
# PV / ST
python_3 = GhPythonScript(x=irrmshy_2)  # -> out, a
# ---------- python_3: Python ----------
__author__ = "chwaibel"
__version__ = "2020.08.21"

import rhinoscriptsyntax as rs

a = x.I_hourly
# ---------- end python_3 ----------
hivemergersolartech = MergerSolarTechHive(
    I_hourlyM=python_3.a,
    SolarTechnologies=hivedistributor.HiveEnergySystemsSurfaceBasedTech,
    AirCarrier=hivedistenvironment.AmbientAirTemp,
    SupplyTemperature=hivedistemitter.HourlyHtgSupTemp,
    ReturnTemperature=hivedistemitter.HourlyHtgRetTemp,
    SimpleMode=toggle_6,
    I_hourly=solarpotentialsunobstructed_2)
python_4 = GhPythonScript(x=hivemergersolartech)  # -> out, a
# ---------- python_4: Python ----------
__author__ = "chwaibel"
__version__ = "2020.08.24"

import rhinoscriptsyntax as rs
a = x.OutputCarriers[0].EnergyMonthlyCumulative

print(type(x.OutputCarriers[0]))
# ---------- end python_4 ----------
panel_9 = Panel(hivemergersolartech)
ma = MassAddition(Input=python_4.a)  # -> Result, PartialResults
graph_2 = QuickGraph(python_4.a, SortOrder=0)
panel_10 = Panel(ma.Result)

# ---- group: PV electricity generation (kWh/month)
panel_11 = Panel(python_4.a)

# ----
# Plug-in any conversion tech
python_5 = GhPythonScript(x=hivemergerchiller)  # -> out, description, outEnergy
# ---------- python_5: Python ----------
__author__ = "chwaibel"
__version__ = "2020.08.18"

import rhinoscriptsyntax as rs

a = ("total investment cost: ", x.SpecificInvestmentCost * x.Capacity)
b = ("capacity: ", x.Capacity)
c = ("cap unit; ", x.CapacityUnit)
d = ("name: ", x.Name)
e = ("opCost CHF/a: ", sum(x.InputCarrier.TotalCost ))
f = ("tot Input Energy kWh/a: ", sum(x.InputCarrier.Energy))
g = ("Tot Output Energy kWh/a: ", sum(x.OutputCarriers[0].EnergyMonthlyCumulative))
h = ("Inp Car PEF: ", x.InputCarrier.PrimaryEnergyFactor)
description = [a, b, c, d, e, f, g, h]

# print(x.InputCarrier.EnergyMonthlyCumulative)
#print(x.OutputCarriers[0].Energy)
print(x.InputCarrier.PrimaryEnergyFactor)
print("Input type: ", type(x.InputCarrier))
print("Output type: ", type(x.OutputCarriers[0]))
outEnergy = x.OutputCarriers[0].EnergyMonthlyCumulative
print(x.IsCooling)
# ---------- end python_5 ----------
panel_12 = Panel(python_5.description)

hivemergeraddedelectricity = MergerAdditionalElectricityHive(
    ElectricityCarrier=hivedistenvironment.GridElectricity,
    DirectElectricity=hivedistconversiontech.DirectElectricity,
    Hourly=toggle_5,
    HiveChiller=hivemergerchiller,
    HiveAirSourceHeatPump=hivemergerashp,
    IdealLoadsElectricity=sia380.ElectricityDemand,
    SolarTechnologies=hivemergersolartech,
    IdealLoadsHeating=sia380.HeatingDemand)  # -> DirectElectricity, FinalHeatingDemand, FinalElectricityDemand

# ----
# Purchased Grid Electricity
# actually redundant. why do I have that? I just need the electricity carrier. Results merger can take care of electricity that I buy?
# 
# NO!! keep it, coz then results merger will work better with a new EnergyHub component. That EHub component would also tell the Results merger how much electricity we need to buy.
# 
# Same for heating. We actually need a PurchasedHeating Component
python_6 = GhPythonScript(chiller=hivemergerchiller, ashp=hivemergerashp, siaElec=sia380.ElectricityDemand, hourly=toggle_5)  # -> out, additionalElec; inputs siaElec: list, hourly: Boolean
# ---------- python_6: Python ----------
__author__ = "Christoph"
__version__ = "2020.09.13"

import rhinoscriptsyntax as rs

if not hourly:
    if chiller != None and ashp != None:
        additionalElec = [a+b+c for a,b,c in zip(chiller.InputCarrier.EnergyMonthlyCumulative, ashp.InputCarrier.EnergyMonthlyCumulative, siaElec)]
    elif ashp != None and chiller is None:
        additionalElec = [a+b for a,b in zip(ashp.InputCarrier.EnergyMonthlyCumulative, siaElec)]
    elif ashp is None and chiller != None:
        additionalElec = [a+b for a,b in zip(chiller.InputCarrier.EnergyMonthlyCumulative, siaElec)]
    else:
        additionalElec = siaElec
else:
    if chiller != None and ashp != None:
        additionalElec = [a+b+c for a,b,c in zip(chiller.InputCarrier.Energy, ashp.InputCarrier.Energy, siaElec)]
    elif ashp != None and chiller is None:
        additionalElec = [a+b for a,b in zip(ashp.InputCarrier.Energy, siaElec)]
    elif ashp is None and chiller != None:
        additionalElec = [a+b for a,b in zip(chiller.InputCarrier.Energy, siaElec)]
    else:
        additionalElec = siaElec
# ---------- end python_6 ----------
python_7 = GhPythonScript(pvOrStList=hivemergersolartech, elecDemandIn=python_6.additionalElec, heatDemandIn=sia380.HeatingDemand, hourly=toggle_5)  # -> out, flatten(elecDemandOut), heatDemandOut; inputs pvOrStList: list, elecDemandIn: list, heatDemandIn: list, hourly: Boolean
# ---------- python_7: Python ----------
__author__ = "Christoph"
__version__ = "2020.09.13"

import rhinoscriptsyntax as rs
import Hive.IO.EnergySystems

horizon = 8760
if not hourly:
    horizon = 12

totalRenewableHeat = [0.0] * horizon
totalRenewableElec = [0.0] * horizon

if not hourly:
    for pvOrSt in pvOrStList:
        if(pvOrSt != None):
            energyRenewable = pvOrSt.OutputCarriers[0].EnergyMonthlyCumulative
        
        if(type(pvOrSt) == Hive.IO.EnergySystems.Photovoltaic or type(pvOrSt) == Hive.IO.EnergySystems.BuildingIntegratedPV):
            totalRenewableElec = [x + y for x, y in zip (totalRenewableElec, energyRenewable)]
        elif(type(pvOrSt) == Hive.IO.EnergySystems.SolarThermal):
            totalRenewableHeat = [x + y for x, y in zip (totalRenewableHeat, energyRenewable)]
else:
    for pvOrSt in pvOrStList:
        if(pvOrSt != None):
            energyRenewable = pvOrSt.OutputCarriers[0].Energy
        
        if(type(pvOrSt) == Hive.IO.EnergySystems.Photovoltaic or type(pvOrSt) == Hive.IO.EnergySystems.BuildingIntegratedPV):
            totalRenewableElec = [x + y for x, y in zip (totalRenewableElec, energyRenewable)]
        elif(type(pvOrSt) == Hive.IO.EnergySystems.SolarThermal):
            totalRenewableHeat = [x + y for x, y in zip (totalRenewableHeat, energyRenewable)]


elecDemandOut = [x - y for x, y in zip(elecDemandIn, totalRenewableElec)]
heatDemandOut = [x - y for x, y in zip(heatDemandIn, totalRenewableHeat)]
# ---------- end python_7 ----------

# ----
# Results
hiveresultscreator = ResultsCreatorHive(
    IdealCoolingLoads=abs,
    IdealSpaceHeatingLoads=python_7.heatDemandOut,
    IdealElectricityLoads=python_7.elecDemandOut,
    IdealDomesticHotWaterLoads=sia380.DomesticHotWaterDemand,
    HiveBuilding=hivedistributor.HiveBuilding,
    HiveConversionTech=flatten([hivemergerchiller, hivemergerashp, hivemergersolartech, hivemergeraddedelectricity.DirectElectricity]),
    Q_T_opaque=sia380.TransmissionHeatLossesOfOpaqueSurfaces,
    Q_T_transparent=sia380.TransmissionHeatLossesOfTransparentSurfaces,
    Q_V=sia380.VentilationHeatLosses,
    Q_i=sia380.InternalGains,
    Q_s=sia380.SolarGains,
    ConsumedElec=abs,
    ConsumedHeat=sia380.HeatingDemand,
    Q_s_per_win=sia380.SolarGainsPerTransparentSurface)

hiveresultsvisualizer = ResultsVisualizerHive(
    hiveresultscreator,
    PlotProperties="""{
  "$type": "System.Collections.Generic.Dictionary`2[[System.String, mscorlib],[System.String, mscorlib]], mscorlib"
}""")
hivedistresults = DistributorResultsHive(Results=hiveresultscreator, ResultType=hiveresultstype)

# ---- group: custom outputs
panel_13 = Panel(hivedistresults)

# ---- group: Hive Results
data_3 = Data(hiveresultscreator)

# ---- group: internalise data to store results
hiveresults = HiveResultsParameter(data_3)

# ----
hivedistresultsloads = DistributorResultsLoadsHive(Results=hiveresultscreator)  # -> HeatingLoads, CoolingLoads, ElectricityLoads, WindowSolarGains, GainsAndLosses

# ---- group: Zone Gains and Losses
panel_14 = Panel(hivedistresultsloads.GainsAndLosses)

# ---- group: Heating Loads
panel_15 = Panel(hivedistresultsloads.HeatingLoads)

# ---- group: Cooling Loads
panel_16 = Panel(hivedistresultsloads.CoolingLoads)

# ---- group: Windows Solar Gains
panel_17 = Panel(hivedistresultsloads.WindowSolarGains)

# ---- group: Electricity Loads
panel_18 = Panel(hivedistresultsloads.ElectricityLoads)
