# Grasshopper definition Hive_FullTemplate.gh (Grasshopper 1.0.7)
# plug-ins: ProvingGround.Conduit, HiveIO, GHSolar

# ---- group: Path to weather file (.epw)
panel = Panel("D:\TEACHING\22_HiveChirag\IND_MH_Mumbai-Andheri.RS.430030_ISHRAE2014.epw")

# ---- group: Ground
mesh = Mesh(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)

# ---- group: Context (City, obstacles, etc.)
mesh_2 = Mesh([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])

# ---- group: static shading
mesh_3 = Mesh(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)

# ---- group: Building volume
brep = Brep(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)

# ---- group: Windows
srf = Surface([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])

# ---- group: PV Fläche
srf_2 = Surface(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)

# ---- group: refine PV discretisation
panel_2 = Panel("4")

# ---- group: refine windows discretisation
panel_3 = Panel("2")
panel_4 = Panel("4")

# ----
mesh_uv = MeshSurface(Surface=srf_2, UCount=panel_2, VCount=panel_2, Overhang=True, Equalize=False)

# ---- group: Hive model description
hiveinputenvironment = InputEnvironmentHive(EpwPath=panel, ObstacleGeometries=[mesh, mesh_2, mesh_3])
hiveinputbuilding = InputBuildingHive(ZoneGeometry=brep, WindowsSurfaces=srf, SiaRoom="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")
hiveinputenergysystems = InputEnergySystemsHive(
    MeshSolarTechnologyProperties=mesh_uv,
    conversions="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",
    emitters="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",
    meshConnections="""{
  "$type": "System.Collections.Generic.Dictionary`2[[System.Int32, mscorlib],[System.Int32, mscorlib]], mscorlib"
}""",
    meshes="""{
  "$type": "Hive.IO.Forms.SurfaceViewModel[], Hive.IO",
  "$values": [
    {
      "$type": "Hive.IO.Forms.SurfaceViewModel, Hive.IO",
      "Name": "srf0",
      "Area": 41.190415189675221
    }
  ]
}""")  # -> flatten(HiveEnergySystems)

# ----
run_hive = BooleanToggle(False)
hivedistributor = MainDistributorHive(HiveInputs=flatten([hiveinputenvironment, hiveinputbuilding, hiveinputenergysystems, run_hive]))  # -> HiveBuilding, HiveEnvironment, HiveEnergySystemsSurfaceBasedTech, HiveEnergySystemsConversionTech, HiveEnergySystemsEmitter

# ---- group: shading mask rec level
toggle = BooleanToggle(False)
number_slider = Slider(3, range=0..5)
number_slider_2 = Slider(0.113, range=0..2)

# ---- group: sun vector HOY
toggle_2 = BooleanToggle(False)
number_slider_3 = Slider(2680, range=0..8759)

# ---- group: show sunpath
toggle_3 = BooleanToggle(False)

# ---- group: Simulate solar?
toggle_4 = BooleanToggle(False)

# ---- group: min (blue) to max (yellow) irradiation (kWh/m^2)
number_slider_4 = Slider(0, range=0..1000)
number_slider_5 = Slider(1000, range=0..2000)

# ---- group: show HUD
toggle_5 = BooleanToggle(True)

# ---- group: HUD for PV (true) or Windows (false)
toggle_6 = BooleanToggle(False)

# ---- group: Show 3D Losses&Gains
toggle_7 = BooleanToggle(True)

# ----
hiveresultstype = HiveResultsType({"Cost - Lifetime Embodied": TotalCostEmbodied, "Cost - Lifetime Embodied Construction": TotalCostEmbodiedConstruction, "Cost - Lifetime Embodied Systems": TotalCostEmbodiedSystems, "Cost - Lifetime Operational": TotalCostOperational, "Cost - Lifetime Operational Construction": TotalCostOperationalConstruction, "Cost - Lifetime Operational Systems": TotalCostOperationalSystems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}, selected="Energy - Active Cooling Monthly": TotalActiveCoolingMonthly)

# ----
# Distributor
hivedistemitter = DistributorEmitterHive(Emitters=hivedistributor.HiveEnergySystemsEmitter)  # -> HourlyHtgSupTemp, HourlyHtgRetTemp, HourlyClgSupTemp, HourlyClgRetTemp
hivedistsolarsimu = DistributorSolarSimulationHive(
    HiveBuilding=hivedistributor.HiveBuilding,
    HiveSolarTechnologies=hivedistributor.HiveEnergySystemsSurfaceBasedTech,
    HiveEnvironment=hivedistributor.HiveEnvironment)  # -> EnvironmentMesh, BuildingCentroid, ExternalSurfaces, WindowGeometries, WindowTilt, WindowAzimuth, WindowAreas, SolarTechMesh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
hivedistconversiontech = DistributorConversionTechHive(ConversionTechnologies=hivedistributor.HiveEnergySystemsConversionTech)  # -> AirSourceHeatPump, Chiller, Boiler, CombinedHeatAndPower, HeatExchanger, ColdExchanger, DirectElectricity
hivedistenvironment = DistributorEnvironmentHive(HiveEnvironment=hivedistributor.HiveEnvironment)  # -> EPW, NaturalGas, BioGas, WoodPellets, DistrictHeating, DistrictCooling, GridElectricity, AmbientAirTemp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
hivedistsiaroom = DistributorSIARoomHive(HiveBuilding=hivedistributor.HiveBuilding)  # -> ZoneAreas, WindowsAreas, ExternalSurfacesAreas, SIA2024Room, AllExternalSurfaceAreas, SurfaceType, SUA2024Schedules, UseAdaptiveComfort, UseNaturalVentilation, UseFixedTimeConstant
bool = Boolean(toggle_4)
python = GhPythonScript(x=hivedistsolarsimu.WindowGeometries, y=bool)  # -> out, a
# ---------- python: Python ----------
__author__ = "chwaibel"
__version__ = "2020.09.09"

import rhinoscriptsyntax as rs

if y:
    a = x
# ---------- end python ----------
python_2 = GhPythonScript(x=hivedistsolarsimu.SolarTechMesh, y=toggle_4)  # -> out, a; same code as python
hivedistepw = DistributorEPW(EPW=hivedistenvironment.EPW, WriteGHNumbers=Toggle(True))  # -> EPW, Latitude, Longitude, CityCountry, GHI, DNI, DHI, DryBulb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
sia2024reader = SIA2024RoomReader(RoomJson=hivedistsiaroom.SIA2024Room, RoomArea=hivedistsiaroom.ZoneAreas, Month=1)  # -> TimeConstant, TemperatureSetpoint, CalculationPeriod, OpaqueEnvelopeArea, WindowArea, U_op_W_m_2K, UValueWindow, VolumetricAirFlowRate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
adaptivecomfort = AdaptiveComfort(AirTemperature=hivedistepw.DryBulb)  # -> ThermalComfort, Comfort80UpperBound, Comfort80LowerBound, Comfort90UpperBound, Comfort90LowerBound

# ---- group: Upper temperature setpoint (°C)
panel_5 = Panel(adaptivecomfort.Comfort80UpperBound)

# ---- group: Lower temperature setpoint (°C)
panel_6 = Panel(adaptivecomfort.Comfort80LowerBound)

# ---- group: Monthly average dry bulb temperature (°C)
panel_7 = Panel(hivedistepw.DryBulbMonthly)

# ---- group: checking windows order
number_slider_6 = Slider(0, range=0..5)  # disabled
item = ListItem(List=hivedistsolarsimu.WindowGeometries, Index=number_slider_6, Wrap=True)  # disabled
offset = OffsetSurface(Surface=item, Distance=0.5, Retrim=True)  # disabled
swatch = ColourSwatch(SwatchColor=RGB(74, 207, 255))  # disabled
preview = CustomPreview(Geometry=offset, Shader=swatch)  # disabled

# ----
graph = QuickGraph([panel_5, panel_6, panel_7], SortOrder=0)

# ---- group: DHI
data = Data(hivedistepw.DHI)

# ----
# Shading Mask
dni = Data(hivedistepw.DNI)
panel_8 = Panel([hivedistepw.Longitude, hivedistepw.Latitude])
pt = Point(hivedistsolarsimu.BuildingCentroid)
skydome = GHSkydome(
    RecursionLevel=number_slider,
    Viewfactors=toggle,
    CumSkyMatrix=Toggle(False),
    SunPath=toggle_3,
    SolarVec=toggle_2,
    HOY=number_slider_3,
    Location=panel_8,
    DNI=dni,
    DHI=data,
    Size=number_slider_2,
    Context=hivedistsolarsimu.EnvironmentMesh,
    Sp=pt,
    Timezone=hivedistepw.Timezone)  # -> Mesh, Vectors, Sunpaths, SunGeo
mesh_4 = Mesh(skydome.Mesh)
preview_2 = CustomPreview(Geometry=skydome.Sunpaths, Shader=ColourSwatch(SwatchColor=RGB(0, 0, 0)))

# ----
# SOLAR SIMULATION
num = Number(number_slider_5)
num_2 = Number(number_slider_4)
mesh_5 = Mesh(hivedistsolarsimu.ExternalSurfaces)
data_2 = Data([0.8, 0.8, 0.8, 0.8, 0.8, 0.8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])
obstobj = ObstacleObject(
    Mesh=[hivedistsolarsimu.EnvironmentMesh, mesh_5],
    Albedo=data_2,
    SpecCoeff=data_2,
    ReflType=0,
    Tolerance=0.01,
    Name="PV",
    MT=True)

# ----
# Solare Wärmeeinträge (shaded)
mesh_uv_2 = MeshSurface(Surface=python.a, UCount=panel_3, VCount=panel_4, Overhang=True, Equalize=False)  # -> flatten(Mesh)
mesh_6 = Mesh(mesh_uv_2)
obstobj_2 = ObstacleObject(Mesh=mesh_6, Albedo=data_2, SpecCoeff=data_2, ReflType=0, Tolerance=0.01, Name="PV", MT=True)
irrmshy = IrradiationMeshYear(
    AnalysisObjects=obstobj_2,
    ObstacleObjects=obstobj,
    Latitude=hivedistepw.Latitude,
    Longitude=hivedistepw.Longitude,
    Year=2017,
    DNI=hivedistepw.DNI,
    DHI=hivedistepw.DHI,
    MainSkyRes=1,
    SpecBounces=0,
    DiffIReflSkyRes=0,
    DiffIReflMode=2,
    MT=True,
    Timezone=hivedistepw.Timezone)
readresults = ReadResults(Mesh=mesh_6, I=irrmshy, Value=7)  # -> Results, SP
visumshsol = VisualizeMeshSolar(Mesh=mesh_6, I=irrmshy, Value=0, Min=num_2, Max=num, Clr=0)

# ---- group: Windows
mesh_7 = Mesh(visumshsol)

# ----
# Solare Wärmeeinträge (unshaded)
solarpotentialsunobstructed = SolarPotentialsUnobstructedCSharp(
    Tilt=hivedistsolarsimu.WindowTilt,
    Azimuth=hivedistsolarsimu.WindowAzimuth,
    DHI=hivedistepw.DHI,
    DNI=hivedistepw.DNI,
    Latitude=hivedistepw.Latitude,
    Longitude=hivedistepw.Longitude,
    Aw=hivedistsolarsimu.WindowAreas,
    Timezone=hivedistepw.Timezone)

# ---- group: hourly demand?
toggle_8 = BooleanToggle(False)

# ----
# PV Ertrag (simuliert)
obstobj_3 = ObstacleObject(Mesh=python_2.a, Albedo=data_2, SpecCoeff=data_2, ReflType=0, Tolerance=0.01, Name="PV", MT=True)
irrmshy_2 = IrradiationMeshYear(
    AnalysisObjects=obstobj_3,
    ObstacleObjects=obstobj,
    Latitude=hivedistepw.Latitude,
    Longitude=hivedistepw.Longitude,
    Year=2017,
    DNI=hivedistepw.DNI,
    DHI=hivedistepw.DHI,
    MainSkyRes=1,
    SpecBounces=0,
    DiffIReflSkyRes=0,
    DiffIReflMode=2,
    MT=True,
    Timezone=0)
readresults_2 = ReadResults(Mesh=python_2.a, I=irrmshy_2, Value=7)  # -> Results, SP
visumshsol_2 = VisualizeMeshSolar(Mesh=hivedistsolarsimu.SolarTechMesh, I=irrmshy_2, Value=0, Min=num_2, Max=num, Clr=0)

# ---- group: PV Panels
mesh_8 = Mesh(visumshsol_2)

# ----
# Conduit
# Solar Simulation Results Colorbar HUD
python_3 = GhPythonScript(toggle_pv=toggle_6, pv_data=readresults_2.Results, window_data=readresults.Results)  # -> out, plot_data, title_plot1, title_plot2; inputs toggle_pv: Boolean, pv_data: tree, window_data: tree
# ---------- python_3: Python ----------
__author__ = "Christoph"
__version__ = "2022.08.01"

import rhinoscriptsyntax as rs
if toggle_pv:
    plot_data = pv_data
    title_plot1 = "Total PV Irradiance (W)"
    title_plot2 = "PV Irradiance (W)"
else:
    plot_data = window_data
    title_plot1 = "Total Windows Irradiance (W)"
    title_plot2 = "Windows Irradiance (W)"
# ---------- end python_3 ----------
genes = GenePool(Decimals=2, Maximum=100, Minimum=0, Value=[66.69, 50, 58.91])
bounds = GetViewportBoundaryDimensions(Refresh=True, Origin=Point(0, 0, 0), Scale=0.25, xDim=456, yDim=381)
flatten = FlattenTree(Tree=python_3.plot_data, Path="{0}")
range = Range(Domain=number_slider_5, Steps=Slider(10, range=0..10))
nblur = BlurNumbers(Numbers=python_3.plot_data, Strength=0.5, Iterations=Slider(1000, range=0..1000), Lock=True, Wrap=False)
partition = PartitionList(List=flatten, Size=Slider(24, range=0..100))
round = Round(Number=range)  # -> Nearest, Floor, Ceiling
rev = ReverseList(List=round.Nearest)
item_2 = ListItem(List=rev, Index=0, Wrap=True)
format = Format(Format="{0}+", Culture=127, Data0=item_2)
vert_tiles = VerticalTiles(
    Boundary=bounds,
    RelativeSizes=genes,
    Width=Slider(0.33, range=0..1),
    WidthPadding=Slider(0.05, range=0..1),
    HeightPadding=Slider(0.2, range=0..1))
genes_2 = GenePool(Decimals=2, Maximum=100, Minimum=0, Value=[21.49, 50])
replace = ReplaceItems(List=rev, Item=format, Indices=Slider(0, range=0..100), Wrap=False)
item_3 = ListItem(List=vert_tiles, Index=0, Wrap=True)  # -> Item2, Item1, Item
flip = FlipMatrix(Data=nblur)
number_slider_7 = Slider(0, range=0..100)
horz_tiles = HorizontalTiles(
    Boundary=item_3.Item1,
    RelativeSizes=genes_2,
    Height=Slider(1, range=0..1),
    WidthPadding=Slider(0, range=0..1),
    HeightPadding=0.02)
ma = MassAddition(Input=flip)  # -> Result, PartialResults
number_slider_8 = Slider(1, range=0..1)
merge = Merge(
    Data1=ColourSwatch(SwatchColor=RGB(255, 255, 0)),
    Data2=ColourSwatch(SwatchColor=RGB(255, 218, 0)),
    Data3=ColourSwatch(SwatchColor=RGB(255, 179, 0)),
    Data4=ColourSwatch(SwatchColor=RGB(255, 138, 0)),
    Data5=ColourSwatch(SwatchColor=RGB(255, 91, 0)),
    Data6=ColourSwatch(SwatchColor=RGB(255, 0, 0)),
    Data7=ColourSwatch(SwatchColor=RGB(204, 0, 51)),
    Data8=ColourSwatch(SwatchColor=RGB(153, 0, 102)),
    Data9=ColourSwatch(SwatchColor=RGB(102, 0, 153)),
    Data10=ColourSwatch(SwatchColor=RGB(51, 0, 204)),
    Data11=ColourSwatch(SwatchColor=RGB(0, 0, 255)))
item_4 = ListItem(List=horz_tiles, Index=0, Wrap=True)
panel_9 = Panel(python_3.title_plot1)
palette = ConduitColorPalette(Seed=3, HueRange=number_slider_7, SaturationRange=number_slider_7, LuminanceRange=number_slider_7, BaseColors=merge)
panel_10 = Panel(python_3.title_plot2)
repeat = RepeatData(Data=number_slider_8, Length=Slider(11, range=0..100))
font = ConduitFont(
    Font="Arial",
    TextHeight=12,
    AdaptiveHeight=True,
    TextSpacing=1.15,
    Alignment=0,
    Bold=False,
    Italic=False,
    Color=ColourSwatch(SwatchColor=RGB(255, 255, 255)))
chart = ConduitChart(Bounds=item_3.Item2, Values=ma.Result, Title=panel_9, ColorPalette=palette, Font=font)  # -> HUDDrawingObjects, ChartSettings
chart_2 = ConduitChart(Bounds=item_3.Item, Values=flip, Title=panel_10, Font=font)  # -> HUDDrawingObjects, ChartSettings
chart_3 = ConduitChart(
    Bounds=item_4,
    Values=repeat,
    Categories=replace,
    Title="Annual Irradiation (kWh/m^2)",
    Range=number_slider_8,
    ColorPalette=palette,
    Font=font)  # -> HUDDrawingObjects, ChartSettings
hud = HeadsUpDisplayHUD(
    ShowHUD=toggle_5,
    DrawingObjects=chart_3.HUDDrawingObjects,
    DrawingBoundary=bounds,
    ConduitStyleSheet="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")
hud_2 = HeadsUpDisplayHUD(
    ShowHUD=toggle_5,
    DrawingObjects=[chart.HUDDrawingObjects, chart_2.HUDDrawingObjects],
    DrawingBoundary=bounds,
    ConduitStyleSheet="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")

# ---- group: NEW SIA 380 COMPONENT
# DEMAND
sia380 = BuildingDemandSIA380(
    RoomProperties=hivedistsiaroom.SIA2024Room,
    RoomSchedules=hivedistsiaroom.SUA2024Schedules,
    FloorArea=hivedistsiaroom.ZoneAreas,
    AirTemperature=hivedistepw.DryBulb,
    SetpointsUpperBounds=adaptivecomfort.Comfort80UpperBound,
    SetpointsLowerBounds=adaptivecomfort.Comfort80LowerBound,
    EnvelopeSurfaceAreas=hivedistsiaroom.AllExternalSurfaceAreas,
    EnvelopeSurfaceTypes=hivedistsiaroom.SurfaceType,
    SurfaceIrradiation=readresults.Results,
    SurfaceIrradiationUnobstructed=solarpotentialsunobstructed,
    GValue=sia2024reader.GValue,
    GValueWithSunscreen=sia2024reader.GValueWithSunscreen,
    SetpointSunscreen=sia2024reader.ShadingSetpoint,
    RunObstructedSolarSimulation=bool,
    RunHourly=toggle_8,
    UseAdaptiveComfort=hivedistsiaroom.UseAdaptiveComfort,
    UseNaturalVentilation=hivedistsiaroom.UseNaturalVentilation,
    UseFixedTimeConstant=hivedistsiaroom.UseFixedTimeConstant)  # -> HeatingDemand, DomesticHotWaterDemand, CoolingDemand, ElectricityDemand, TransmissionHeatLosses, VentilationHeatLosses, InternalGains, SolarGains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
abs = Absolute(Value=sia380.CoolingDemand)

# ----
# PV Ertrag (unverschattet)
# Q_s = G * F_F * A_w * g
# [Q_s] = kWh
# [G] = kWh/m^2
# [F_F] = -
# [A_w] = m^2
# [g] = -
solarpotentialsunobstructed_2 = SolarPotentialsUnobstructedCSharp(
    Tilt=hivedistsolarsimu.SolarTechTilt,
    Azimuth=hivedistsolarsimu.SolarTechAzimuth,
    DHI=hivedistepw.DHI,
    DNI=hivedistepw.DNI,
    Latitude=hivedistepw.Latitude,
    Longitude=hivedistepw.Longitude,
    Aw=1,
    Timezone=hivedistepw.Timezone)

# ----
# 3D Arrows Losses & Gains
dist3dlossesgains = Dist3DLossesGains(
    TransparentSurfaceAreas=hivedistsiaroom.WindowsAreas,
    OpaqueSurfaceAreas=hivedistsiaroom.ExternalSurfacesAreas,
    MonthlySolarGainsPerWindow=sia380.SolarGainsPerTransparentSurface,
    MonthlyTransmissionLossesAllWindows=sia380.TransmissionHeatLossesOfTransparentSurfaces,
    MonthlyTransmissionLossesAllWalls=sia380.TransmissionHeatLossesOfOpaqueSurfaces)  # -> TotalLossesPerWindow, TotalLossesPerOpaque, TotalGainsPerWindow
_3dlossesgains = _3DLossesGains(
    DisplayToggle=toggle_7,
    ValueScaleFactor=Slider(0.008, range=0..0.01),
    WallsSurfaceCollection=hivedistsolarsimu.ExternalSurfaces,
    WindowsSurfaceCollection=hivedistsolarsimu.WindowGeometries,
    TotalLossesPerWindow=dist3dlossesgains.TotalLossesPerWindow,
    TotalLossesPerOpaque=dist3dlossesgains.TotalLossesPerOpaque,
    TotalGainsPerWindow=dist3dlossesgains.TotalGainsPerWindow)  # -> WindowLossAnchorPoints, WindowLossVectors, WindowGainAnchorPoints, WindowGainVectors, WallLossAnchorPoints, WallLossVectors
vdis = VectorDisplay(Anchor=_3dlossesgains.WindowLossAnchorPoints, Vector=_3dlossesgains.WindowLossVectors)
vdis_2 = VectorDisplay(Anchor=_3dlossesgains.WindowGainAnchorPoints, Vector=_3dlossesgains.WindowGainVectors)
vdis_3 = VectorDisplay(Anchor=_3dlossesgains.WallLossAnchorPoints, Vector=_3dlossesgains.WallLossVectors)
number_slider_9 = Slider(0.5, range=0..1)
addition = Addition(A=_3dlossesgains.WallLossAnchorPoints, B=_3dlossesgains.WallLossVectors)
addition_2 = Addition(A=_3dlossesgains.WindowGainAnchorPoints, B=_3dlossesgains.WindowGainVectors)
addition_3 = Addition(A=_3dlossesgains.WindowLossAnchorPoints, B=_3dlossesgains.WindowLossVectors)
tag = TextTag3D(Location=addition, Text=dist3dlossesgains.TotalLossesPerOpaque, Size=number_slider_9, Justification=7)
tag_2 = TextTag3D(
    Location=addition_2,
    Text=dist3dlossesgains.TotalGainsPerWindow,
    Size=number_slider_9,
    Colour=ColourSwatch(SwatchColor=RGB(70, 211, 48)),
    Justification=7)
tag_3 = TextTag3D(
    Location=addition_3,
    Text=dist3dlossesgains.TotalLossesPerWindow,
    Size=number_slider_9,
    Colour=ColourSwatch(SwatchColor=RGB(83, 50, 255)),
    Justification=7)

# ---- group: Simple efficiency calculations?
toggle_9 = BooleanToggle(False)

# ----
# Air Source Heat Pump
panel_11 = Panel("True")
hivemergerashp = MergerAirSourceHeatPumpHive(
    AirCarrier=hivedistenvironment.AmbientAirTemp,
    ElectricityCarrier=hivedistenvironment.GridElectricity,
    HeatingGenerated=sia380.HeatingDemand,
    SupplyTemperature=hivedistemitter.HourlyHtgSupTemp,
    SimpleMode=toggle_9,
    PessimisticCOP=panel_11,
    HiveAirSourceHeatPump=hivedistconversiontech.AirSourceHeatPump)

# ----
# Chiller
hivemergerchiller = MergerChillerHive(
    AirCarrier=hivedistenvironment.AmbientAirTemp,
    ElectricityCarrier=hivedistenvironment.GridElectricity,
    CoolingGenerated=abs,
    SupplyTemperature=hivedistemitter.HourlyClgSupTemp,
    SimpleMode=toggle_9,
    HiveChiller=hivedistconversiontech.Chiller)

# ----
# PV / ST
python_4 = GhPythonScript(x=irrmshy_2)  # -> out, a
# ---------- python_4: Python ----------
__author__ = "chwaibel"
__version__ = "2020.08.21"

import rhinoscriptsyntax as rs

a = x.I_hourly
# ---------- end python_4 ----------
hivemergersolartech = MergerSolarTechHive(
    I_hourlyM=python_4.a,
    SolarTechnologies=hivedistributor.HiveEnergySystemsSurfaceBasedTech,
    AirCarrier=hivedistenvironment.AmbientAirTemp,
    SupplyTemperature=hivedistemitter.HourlyHtgSupTemp,
    ReturnTemperature=hivedistemitter.HourlyHtgRetTemp,
    SimpleMode=toggle_9,
    I_hourly=solarpotentialsunobstructed_2)
python_5 = GhPythonScript(x=hivemergersolartech)  # -> out, a
# ---------- python_5: Python ----------
__author__ = "chwaibel"
__version__ = "2020.08.24"

import rhinoscriptsyntax as rs
a = x.OutputCarriers[0].EnergyMonthlyCumulative
# ---------- end python_5 ----------
panel_12 = Panel(hivemergersolartech)  # disabled
ma_2 = MassAddition(Input=python_5.a)  # -> Result, PartialResults; disabled
graph_2 = QuickGraph(python_5.a, SortOrder=0)
panel_13 = Panel(ma_2.Result)  # disabled

# ---- group: PV electricity generation (kWh/month)
panel_14 = Panel(python_5.a)

# ----
# Plug-in any conversion tech
python_6 = GhPythonScript(x=hivemergerchiller)  # -> out, description, outEnergy; disabled
# ---------- python_6: Python ----------
__author__ = "chwaibel"
__version__ = "2020.08.18"

import rhinoscriptsyntax as rs

a = ("total investment cost: ", x.SpecificInvestmentCost * x.Capacity)
b = ("capacity: ", x.Capacity)
c = ("cap unit; ", x.CapacityUnit)
d = ("name: ", x.Name)
e = ("opCost CHF/a: ", sum(x.InputCarrier.TotalCost ))
f = ("tot Input Energy kWh/a: ", sum(x.InputCarrier.Energy))
g = ("Tot Output Energy kWh/a: ", sum(x.OutputCarriers[0].EnergyMonthlyCumulative))
h = ("Inp Car PEF: ", x.InputCarrier.PrimaryEnergyFactor)
description = [a, b, c, d, e, f, g, h]

# print(x.InputCarrier.EnergyMonthlyCumulative)
#print(x.OutputCarriers[0].Energy)
print(x.InputCarrier.PrimaryEnergyFactor)
print("Input type: ", type(x.InputCarrier))
print("Output type: ", type(x.OutputCarriers[0]))
outEnergy = x.OutputCarriers[0].EnergyMonthlyCumulative
print(x.IsCooling)
# ---------- end python_6 ----------
panel_15 = Panel(python_6.description)  # disabled

# ----
# Purchased Grid Electricity
# & final heating energy
hivemergeraddedelectricity = MergerAdditionalElectricityHive(
    ElectricityCarrier=hivedistenvironment.GridElectricity,
    DirectElectricity=hivedistconversiontech.DirectElectricity,
    Hourly=toggle_8,
    HiveChiller=hivemergerchiller,
    HiveAirSourceHeatPump=hivemergerashp,
    IdealLoadsElectricity=sia380.ElectricityDemand,
    SolarTechnologies=hivemergersolartech,
    IdealLoadsHeating=sia380.HeatingDemand)  # -> DirectElectricity, FinalHeatingDemand, FinalElectricityDemand

# ----
# Results
hiveresultscreator = ResultsCreatorHive(
    IdealCoolingLoads=abs,
    IdealSpaceHeatingLoads=hivemergeraddedelectricity.FinalHeatingDemand,
    IdealElectricityLoads=hivemergeraddedelectricity.FinalElectricityDemand,
    IdealDomesticHotWaterLoads=sia380.DomesticHotWaterDemand,
    HiveBuilding=hivedistributor.HiveBuilding,
    HiveConversionTech=flatten([hivemergerchiller, hivemergerashp, hivemergersolartech, hivemergeraddedelectricity.DirectElectricity]),
    Q_T_opaque=sia380.TransmissionHeatLossesOfOpaqueSurfaces,
    Q_T_transparent=sia380.TransmissionHeatLossesOfTransparentSurfaces,
    Q_V=sia380.VentilationHeatLosses,
    Q_i=sia380.InternalGains,
    Q_s=sia380.SolarGains,
    ConsumedElec=sia380.ElectricityDemand,
    ConsumedHeat=sia380.HeatingDemand,
    Q_s_per_win=sia380.SolarGainsPerTransparentSurface)

hiveresultsvisualizer = ResultsVisualizerHive(
    hiveresultscreator,
    PlotProperties="""{
  "$type": "System.Collections.Generic.Dictionary`2[[System.String, mscorlib],[System.String, mscorlib]], mscorlib"
}""")
hivedistresults = DistributorResultsHive(Results=hiveresultscreator, ResultType=hiveresultstype)

# ---- group: custom outputs
panel_16 = Panel(hivedistresults)

# ---- group: Hive Results
data_3 = Data(hiveresultscreator)

# ---- group: internalize results here!
hiveresultsparameter = ResultsParameterHive(data_3)

# ----
hivedistresultsloads = DistributorResultsLoadsHive(Results=hiveresultscreator)  # -> HeatingLoads, CoolingLoads, ElectricityLoads, WindowSolarGains, GainsAndLosses

# ---- group: Zone Gains and Losses
panel_17 = Panel(hivedistresultsloads.GainsAndLosses)

# ---- group: Heating Loads
panel_18 = Panel(hivedistresultsloads.HeatingLoads)

# ---- group: Cooling Loads
panel_19 = Panel(hivedistresultsloads.CoolingLoads)

# ---- group: Windows Solar Gains
panel_20 = Panel(hivedistresultsloads.WindowSolarGains)

# ---- group: Electricity Loads
panel_21 = Panel(hivedistresultsloads.ElectricityLoads)
