# Grasshopper definition Hive_Results_Visualizer_Test.gh (Grasshopper 1.0.7)
# plug-ins: HiveIO

# ---- group: heating
data = Data(["50.029929", "37.862895", "25.837209", "8.7003", "0.741364", "0.007886", "0.000672", "0.002471", "2.258486", "16.063257", "35.74919", "48.328382"])

# ---- group: elec
data_2 = Data(["3.852624", "3.852624", "3.852624", "3.852624", "3.852624", "3.852624", "3.852624", "3.852624", "3.852624", "3.852624", "3.852624", "3.852624"])

# ----
ghresults = GHResults(HtgMonthly=data, ElecMonthly=data_2)
panel = Panel(ghresults)
hive_io_visualizer = HiveIOVisualizer(ghresults)
