# Grasshopper definition simple_panel.gh (Grasshopper 1.0.7)
# plug-ins: solar

# ---- group: replace with grasshopper component that reads a surface of a building
number_slider = Slider(164.524, range=0..360)
# Do this for each surface of a building and the average all for simplified SIA 380 component
number_slider_2 = Slider(0, range=0..90)

# ----
data = Data([0, 0, 0, 0, 0, 0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])
data_2 = Data([0, 0, 0, 0, 0, 0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])
simplepanel = SimplePanel(
    Tilt=number_slider_2,
    Azimuth=number_slider,
    DHI=data,
    DNI=data_2,
    Latitude=Slider(43.571, range=-90..90),
    Longitude=Slider(163.354, range=-180..180))
graph = QuickGraph(simplepanel, SortOrder=0)
